# Grasshopper definition 05_Dim_Type_Side.gh (Grasshopper 1.0.8)
# plug-ins: Pufferfish, Rhino.Inside for Autodesk Revit

doubleclick = BooleanToggle(False)
dss_annotation_panel = Panel("Help on WhiteWork")
dss_log_v5_2 = PythonScript(Help=doubleclick)  # inputs Help: Boolean
# ---------- dss_log_v5_2: Python ----------
"""
Set grasshopper template and provide easy acces to Help file in intranet

"""

"""
Credits:
    20211117
    Created by Vladimir Ondejcik
    White arkitekter AB

Based on:
    WOMBAT version <0.0.1>
    Script by <Brian Ringley>
        def libraries() by <Giulio Piacentino> see <http://www.grasshopper3d.com/forum/topics/gh-filename-is-python>
        def writeToFile() by <Data Analytics Society> see <https://www.youtube.com/watch?v=-TF3mXhnCDw>
    Script version <15 September 2015> 
    Copyright <Creative Commons Sharealike>
"""


#add dsearch default path located on cad.local
import sys
new_path = r"\\sesthfs02\DSEARCH\REPOSITORY\Grasshopper\Xtras\DsearchCode"
if new_path not in sys.path: sys.path.append(new_path)

#import dsearch plugin
import dsearch as ds

import os

print sys.path

#reload module (this has use when working on module)
#reload(ds.DS_Log)
#reload(ds.DS_Links)

#setup template
template=ds.DS_Links.Template
ds.DS_Log.DS_Template(template)

#run help from module 
if Help:
    helpLink=ds.DS_Links.HelpLink
    ds.DS_Log.DS_Help(helpLink)

    #turn toggle back to false
    obj=ghenv.Component.Params.Input[0].Sources[0]
    obj.Value=False
    obj.ExpireSolution(True)
# ---------- end dss_log_v5_2 ----------

dss_projectnumber = Panel("0000")
dss_projectname = Panel("name")

# ----
# Organization of Grasshopper scripts at White:
# Script should be created and annotated always with notion that other person will need to use/edit them.
# Build your script in modules and segments, use color coding and annotation according this template.
# This standard should be applied to all scripts, big or small.
# 
# Read  guide on white work:
# "https://work.white.se/grasshopper-developer-guide/"
# For Advanced users:
# For design scripts running more than a month use "dsInitialize" and "dsScriptLog" functions on Dsearch tab to log changes over time.
dss_annotation_panel_2 = Panel("""Tip of a day:
You can change default colour grups by right clicking
Graphical templates are located on "Dsearch" tab""")
# GRAPHIC
# STANDARD
# In
# data and geometry import from rhino or external platforms
image = ImageSampler(dss_annotation_panel_2, Filter="Colour", Interpolate=False, Umax=1, Umin=0, Vmax=1, Vmin=0, Wrap=0)

active_selection = GraphicalElement()
position_of_dimension_might_effect_resul = Panel("200")  # "Position of dimension - might effect results"
e_category = ElementCategory(Element=active_selection)  # -> Element, Category
# Segment
# group modules into larger coherent parts
# User Interface: I/O
e_type = ElementType(Element=active_selection)  # -> Element, Type
# Dim to center or side!
boolean_toggle = BooleanToggle(True)
a_view = ActiveView()

# ---- group: Style of dimension
types = QueryTypes(Kind=7)

# ----
categories = QueryCategories(Type=1, Name="Walls", IsVisibleUI=True, IsSubcategory=False)
level = Level(a_view)
levelfltr = LevelFilter(Levels=level, Inverted=False)
# general annotation and notes
typefltr = TypeFilter(Types=e_type.Type, Inverted=False)
levelfltr_2 = LevelFilter(Levels=level, Inverted=False)
v_elements = QueryViewElements(View=a_view, Categories=categories, Filter=levelfltr_2)
andfltr = LogicalAndFilter(FilterA=typefltr, FilterB=levelfltr)

# ---- group: Color of dimensions
colour_swatch = ColourSwatch(SwatchColor=RGB(204, 54, 49))

# ----
elements = QueryElements(Filter=andfltr)  # -> Elements, Count

# ---- group: Sortering av långsidor Vägg
location = ElementCurve(Element=v_elements)  # -> Element, Curve
line = Line(location.Curve)
null = NullItem(Item=line)  # -> NullFlags, InvalidFlags, Description
cull = CullPattern(List=location.Element, CullPattern=invert(null.NullFlags))
cull_2 = CullPattern(List=line, CullPattern=invert(null.NullFlags))
vec = Vector(cull_2)

# ----
tmatch = MatchText(Text=types, RegEx="Kontroll", Case=True)
tmatch_2 = MatchText(Text=types, RegEx="Längdmåttsättning*", Case=True)
graphical_element = GraphicalElement(elements.Elements)
cull_3 = CullPattern(List=types, CullPattern=tmatch)

# ----
# Control
# General
# Monitor
# variable parameters and script execution
# (sliders, boolean togggle, text input,...)
# monitor data and geometry preview (used for panels for example)
# WIP
# Annotation
# Plugin
# textbased scripting and special plugins
# f.ex: HumanUI, kangaroo,...
# problematic or under repair or construction
dss_annotation_panel_3 = Panel("general development modules")  # disabled

cull_4 = CullPattern(List=types, CullPattern=tmatch_2)
item = ListItem(List=cull_3, Index=0, Wrap=True)

# ---- group: Hittar referensplan(finns i nästan alla familjer)
p_reference = ComponentReferencePlane(Component=graphical_element, Name="Center (Left/Right)")

# ----
lng = ListLength(List=item)
null_2 = NullItem(Item=lng)  # -> NullFlags, InvalidFlags, Description
item_2 = ListItem(List=item, Index=0, Wrap=True)
e_references = ElementReferences(Element=graphical_element)  # -> simplify(Faces), Edges, Lines
item_3 = ListItem(List=cull_4, Index=Slider(42, range=0..100), Wrap=True)
panel = Panel("3")
filter = StreamFilter(Gate=null_2.NullFlags, Stream0=item_2, Stream1=item_3)
duplicate = DuplicateType(TypeName="Dimension_RiR", Type=filter, FailureProcessingMode=1, TrackingMode=2)

# ---- group: Hittar en centerpunkt att arbeta med
brec = BoundingRectangle(Geometry=simplify(graft(graphical_element)), Plane=PlaneXY(0, 0, 0), Axis=0, Slide=0, Union=True)  # -> Bounding, DimensionX, DimensionY
# Out
# output data to rhino or external platforms
pcen = PolygonCenter(Polyline=brec.Bounding)  # -> simplify(CenterV), CenterE, CenterA

# ----
e_name = ElementName(Element=duplicate)  # -> Element, Name

# ---- group: Creating new dimension style
inspect_element = InspectElement(Element=duplicate)
param = ElementParameter(Element=duplicate, Parameter=inspect_element, Value=colour_swatch)  # -> Element, Value

# ----
inspect_element_2 = InspectElement(Element=duplicate)

# ---- group: Flyttar
pln = Plane(p_reference)
pt = Point(pcen.CenterV)
deplane = DeconstructPlane(Plane=pln)  # -> Origin, XAxis, YAxis, ZAxis

# ----
project = Project(Geometry=pt, Plane=simplify(graft(pln)))  # -> simplify(Geometry), Transform
addition = Addition(A=position_of_dimension_might_effect_resul, B="500")

# ---- group: Flyttar / Flyttar en punkt för att skapa en vektor
number_slider = Slider(500, range=0..1000)
num = Number(addition)
neg = Negative(Value=num)
multiplication = Multiplication(A=deplane.XAxis, B=neg)
num_2 = Number(addition)
vec_2 = Vector(multiplication)
neg_2 = Negative(Value=num_2)
move = Move(Geometry=project.Geometry, Motion=simplify(graft(vec_2)))  # -> Geometry, Transform
multiplication_2 = Multiplication(A=deplane.YAxis, B=neg_2)
vec_3 = Vector(multiplication_2)
move_2 = Move(Geometry=move.Geometry, Motion=simplify(graft(vec_3)))  # -> Geometry, Transform

# ----
param_2 = ElementParameter(Element=duplicate, Parameter=inspect_element_2, Value=Slider(1, range=0..1))  # -> Element, Value

# ---- group: Flyttar / Flyttar en punkt för att flytta dimension bort från objektet
num_3 = Number(position_of_dimension_might_effect_resul)
neg_3 = Negative(Value=num_3)
multiplication_3 = Multiplication(A=deplane.XAxis, B=neg_3)
num_4 = Number(position_of_dimension_might_effect_resul)
vec_4 = Vector(multiplication_3)
neg_4 = Negative(Value=num_4)
move_3 = Move(Geometry=project.Geometry, Motion=simplify(graft(vec_4)))  # -> Geometry, Transform
multiplication_4 = Multiplication(A=deplane.YAxis, B=neg_4)
vec_5 = Vector(multiplication_4)
move_4 = Move(Geometry=move_3.Geometry, Motion=simplify(graft(vec_5)))  # -> Geometry, Transform

# ---- group: Reducerar antalet väggar till de vinkelräta mot objektets center plan
pt_2 = Point(move_4.Geometry)
pt_3 = Point(project.Geometry)
vec_6 = Vector(unitize(vec))
vec2pt = Vector2Pt(PointA=pt_3, PointB=pt_2, Unitize=False)  # -> unitize(Vector), Length
dprod = DotProduct(VectorA=unitize(vec2pt.Vector), VectorB=unitize(vec_6), Unitize=True)  # -> simplify(DotProduct)
abs = Absolute(Value=dprod)
bool = Boolean(abs)

# ---- group: Hittar den närmaste vägg som elementet är parallelt med
cull_5 = CullPattern(List=flatten(cull), CullPattern=bool)
pt_4 = Point(move_2.Geometry)
line_2 = Line(cull_5)
crv_cp = CurveClosestPoint(Point=pt_4, Curve=reparameterize(line_2))  # -> simplify(Point), simplify(Parameter), simplify(Distance)
bool_2 = Boolean(crv_cp.Parameter)
num_5 = Number(crv_cp.Parameter)
replace = ReplaceMembers(Set=num_5, Find=Slider(1, range=0..1), Replace=Slider(0, range=0..1))
bool_3 = Boolean(replace)
cull_6 = CullPattern(List=crv_cp.Point, CullPattern=bool_3)
cull_7 = CullPattern(List=crv_cp.Distance, CullPattern=bool_3)
cull_8 = CullPattern(List=cull_5, CullPattern=bool_3)
sort = SortList(Keys=cull_7, ValuesA=cull_8)  # -> Keys, simplify(ValuesA)
sort_2 = SortList(Keys=cull_7, ValuesA=cull_6)  # -> Keys, simplify(ValuesA)
item_4 = ListItem(List=sort_2.ValuesA, Index=0, Wrap=True)
pln_2 = Plane(level)
project_2 = Project(Geometry=pt_4, Plane=pln_2)  # -> Geometry, Transform
project_3 = Project(Geometry=item_4, Plane=pln_2)  # -> Geometry, Transform
ln = Line(StartPoint=project_2.Geometry, EndPoint=project_3.Geometry)
line_3 = Line(ln)

cull_9 = CullPattern(List=flatten(cull), CullPattern=bool)
pt_5 = Point(move_4.Geometry)
line_4 = Line(cull_9)
crv_cp_2 = CurveClosestPoint(Point=pt_5, Curve=reparameterize(line_4))  # -> simplify(Point), simplify(Parameter), simplify(Distance)
bool_4 = Boolean(crv_cp_2.Parameter)
num_6 = Number(crv_cp_2.Parameter)
replace_2 = ReplaceMembers(Set=num_6, Find=Slider(1, range=0..1), Replace=Slider(0, range=0..1))
bool_5 = Boolean(replace_2)
cull_10 = CullPattern(List=crv_cp_2.Point, CullPattern=bool_5)
cull_11 = CullPattern(List=crv_cp_2.Distance, CullPattern=bool_5)
cull_12 = CullPattern(List=cull_9, CullPattern=bool_5)
sort_3 = SortList(Keys=cull_11, ValuesA=cull_12)  # -> Keys, simplify(ValuesA)
sort_4 = SortList(Keys=cull_11, ValuesA=cull_10)  # -> Keys, simplify(ValuesA)
item_5 = ListItem(List=sort_4.ValuesA, Index=0, Wrap=True)
pln_3 = Plane(level)
project_4 = Project(Geometry=pt_5, Plane=pln_3)  # -> Geometry, Transform
project_5 = Project(Geometry=item_5, Plane=pln_3)  # -> Geometry, Transform
ln_2 = Line(StartPoint=project_4.Geometry, EndPoint=project_5.Geometry)
line_5 = Line(ln_2)

# ----
len = Length(Curve=line_5)

# ---- group: Hittar den närmaste vägg som elementet är parallelt med
cull_13 = CullPattern(List=flatten(cull), CullPattern=invert(bool))
# Kanske projektion av linjer ska vara någon annan stans
pt_6 = Point(move_4.Geometry)
line_6 = Line(cull_13)
crv_cp_3 = CurveClosestPoint(Point=pt_6, Curve=reparameterize(line_6))  # -> simplify(Point), simplify(Parameter), simplify(Distance)
bool_6 = Boolean(crv_cp_3.Parameter)
num_7 = Number(crv_cp_3.Parameter)
replace_3 = ReplaceMembers(Set=num_7, Find=Slider(1, range=0..1), Replace=Slider(0, range=0..1))
bool_7 = Boolean(replace_3)
cull_14 = CullPattern(List=crv_cp_3.Point, CullPattern=bool_7)
cull_15 = CullPattern(List=crv_cp_3.Distance, CullPattern=bool_7)
cull_16 = CullPattern(List=cull_13, CullPattern=bool_7)
sort_5 = SortList(Keys=cull_15, ValuesA=cull_16)  # -> Keys, simplify(ValuesA)
sort_6 = SortList(Keys=cull_15, ValuesA=cull_14)  # -> Keys, simplify(ValuesA)
item_6 = ListItem(List=sort_6.ValuesA, Index=0, Wrap=True)
pln_4 = Plane(level)
project_6 = Project(Geometry=pt_6, Plane=pln_4)  # -> Geometry, Transform
project_7 = Project(Geometry=item_6, Plane=pln_4)  # -> Geometry, Transform
ln_3 = Line(StartPoint=project_6.Geometry, EndPoint=project_7.Geometry)
line_7 = Line(ln_3)

# ---- group: Picking the shortest
merge = Merge(Data1=line_5, Data2=line_3)
len_2 = Length(Curve=merge)
sort_7 = SortList(Keys=len_2, ValuesA=merge)  # -> Keys, ValuesA
item_7 = ListItem(List=sort_7.ValuesA, Index=0, Wrap=True)

# ---- group: Hittar referensplan(finns i nästan alla familjer)
p_reference_2 = ComponentReferencePlane(Component=graphical_element, Name="Center (Left/Right)")

# ----
Z = UnitZ(Factor=1)

# ---- group: CenterPlane
data = Data(p_reference)

data_2 = Data(p_reference)

# ---- group: DIM TO SIDE-FINDS SIDE REFERENCE
face = Face(e_references.Faces)
face_2 = Face(p_reference)
deconstruct_plane = DeconstructPlane(Plane=face)  # -> Origin, XAxis, YAxis, ZAxis
deconstruct_plane_2 = DeconstructPlane(Plane=face_2)  # -> Origin, XAxis, YAxis, ZAxis
null_item = NullItem(Item=deconstruct_plane.ZAxis)  # -> NullFlags, InvalidFlags, Description
cull_pattern = CullPattern(List=face, CullPattern=invert(null_item.InvalidFlags))
cull_pattern_2 = CullPattern(List=deconstruct_plane.ZAxis, CullPattern=invert(null_item.InvalidFlags))
dot_product = DotProduct(VectorA=simplify(graft(deconstruct_plane_2.ZAxis)), VectorB=cull_pattern_2, Unitize=False)
boolean = Boolean(dot_product)
cull_pattern_3 = CullPattern(List=cull_pattern, CullPattern=boolean)
face_3 = Face(cull_pattern_3)
plane = Plane(cull_pattern_3)
deconstruct_plane_3 = DeconstructPlane(Plane=plane)  # -> Origin, XAxis, YAxis, ZAxis

# ---- group: Hittar långsidor på en vägg
item_8 = ListItem(List=sort_3.ValuesA, Index=0, Wrap=True)
md_slider = MDSlider(SliderMode=0, slider_value=Point(0.5, 0.5, 0.5), x_domain=Domain(0, 1), y_domain=Domain(0, 1), z_domain=Domain(0, 1))
line_8 = Line(item_8)
e_references_2 = ElementReferences(Element=item_8)  # -> simplify(Faces), Edges, Lines
Z_2 = UnitZ(Factor=1)
vec_7 = Vector(line_8)
srf = Surface(e_references_2.Faces)
xprod = CrossProduct(VectorA=vec_7, VectorB=Z_2, Unitize=Toggle(True))  # -> Vector, Length
evalsrf = EvaluateSurface(Surface=srf, Point=md_slider)  # -> Point, Normal, UDirection, VDirection, Frame
dprod_2 = DotProduct(VectorA=simplify(graft(xprod.Vector)), VectorB=evalsrf.Normal, Unitize=False)
abs_2 = Absolute(Value=dprod_2)
cull_17 = CullPattern(List=e_references_2.Faces, CullPattern=abs_2)

# ----
cp = PlaneClosestPoint(Point=move_4.Geometry, Plane=cull_17)  # -> Point, UVPoint, Distance

# ---- group: Hittar långsidor på en vägg (continued)
abs_3 = Absolute(Value=cp.Distance)
sort_8 = SortList(Keys=abs_3, ValuesA=cull_17)  # -> Keys, ValuesA
item_9 = ListItem(List=sort_8.ValuesA, Index=0, Wrap=True)
referenser = Data(item_9)

# ---- group: DIM TO SIDE-FINDS SIDE REFERENCE
face_4 = Face(p_reference_2)
face_5 = Face(e_references.Faces)
deconstruct_plane_4 = DeconstructPlane(Plane=face_4)  # -> Origin, XAxis, YAxis, ZAxis
deconstruct_plane_5 = DeconstructPlane(Plane=face_5)  # -> Origin, XAxis, YAxis, ZAxis
null_item_2 = NullItem(Item=deconstruct_plane_5.ZAxis)  # -> NullFlags, InvalidFlags, Description
cull_pattern_4 = CullPattern(List=face_5, CullPattern=invert(null_item_2.InvalidFlags))
cull_pattern_5 = CullPattern(List=deconstruct_plane_5.ZAxis, CullPattern=invert(null_item_2.InvalidFlags))

# ----
xprod_2 = CrossProduct(VectorA=deconstruct_plane_4.ZAxis, VectorB=Z, Unitize=False)  # -> Vector, Length

# ---- group: Hittar långsidor på en vägg
item_10 = ListItem(List=sort_5.ValuesA, Index=0, Wrap=True)
md_slider_2 = MDSlider(SliderMode=0, slider_value=Point(0.5, 0.5, 0.5), x_domain=Domain(0, 1), y_domain=Domain(0, 1), z_domain=Domain(0, 1))
line_9 = Line(item_10)
e_references_3 = ElementReferences(Element=item_10)  # -> simplify(Faces), Edges, Lines
Z_3 = UnitZ(Factor=1)
vec_8 = Vector(line_9)
srf_2 = Surface(e_references_3.Faces)
xprod_3 = CrossProduct(VectorA=vec_8, VectorB=Z_3, Unitize=Toggle(True))  # -> Vector, Length
evalsrf_2 = EvaluateSurface(Surface=srf_2, Point=md_slider_2)  # -> Point, Normal, UDirection, VDirection, Frame
dprod_3 = DotProduct(VectorA=simplify(graft(xprod_3.Vector)), VectorB=evalsrf_2.Normal, Unitize=False)
abs_4 = Absolute(Value=dprod_3)
cull_18 = CullPattern(List=e_references_3.Faces, CullPattern=abs_4)

# ----
cp_2 = PlaneClosestPoint(Point=move_4.Geometry, Plane=cull_18)  # -> Point, UVPoint, Distance

# ---- group: Hittar långsidor på en vägg (continued)
abs_5 = Absolute(Value=cp_2.Distance)
sort_9 = SortList(Keys=abs_5, ValuesA=cull_18)  # -> Keys, ValuesA
item_11 = ListItem(List=sort_9.ValuesA, Index=0, Wrap=True)
referenser_2 = Data(item_11)

# ---- group: DIM TO SIDE-FINDS SIDE REFERENCE (continued)
dot_product_2 = DotProduct(VectorA=simplify(graft(xprod_2.Vector)), VectorB=cull_pattern_5, Unitize=False)
boolean_2 = Boolean(dot_product_2)
cull_pattern_6 = CullPattern(List=cull_pattern_4, CullPattern=boolean_2)
face_6 = Face(cull_pattern_6)
plane_2 = Plane(cull_pattern_6)
deconstruct_plane_6 = DeconstructPlane(Plane=plane_2)  # -> Origin, XAxis, YAxis, ZAxis
line_10 = Line(item_10)

line_11 = Line(item_8)

# ---- group: Collect references and lines and creates dimension
data_3 = Data(item_9)
view = View(a_view)
type = Type(param.Element)
line_12 = Line(item_7)

# ---- group: DIM TO SIDE-FINDS SIDE REFERENCE (continued)
project_8 = Project(Geometry=deconstruct_plane_3.Origin, Plane=view)  # -> Geometry, Transform
curve_closest_point = CurveClosestPoint(Point=project_8.Geometry, Curve=line_11)  # -> Point, Parameter, Distance
sort_list = SortList(Keys=curve_closest_point.Distance, ValuesValuesA=face_3, ValuesA=curve_closest_point.Point)  # -> Keys, ValuesValuesA, ValuesA
list_item = ListItem(List=sort_list.ValuesValuesA, Index=0, Wrap=True)  # -> flatten(Item)

# ----
data_4 = Data(list_item)
null_item_3 = NullItem(Item=list_item)  # -> NullFlags, InvalidFlags, Description
cull_pattern_7 = CullPattern(List=simplify(graft(data)), CullPattern=simplify(graft(null_item_3.NullFlags)))
cull_pattern_8 = CullPattern(List=simplify(graft(data_4)), CullPattern=invert(simplify(graft(null_item_3.NullFlags))))
merge_2 = Merge(Data1=cull_pattern_7, Data2=cull_pattern_8)  # -> flatten(Result)
stream_filter = StreamFilter(Gate=boolean_toggle, Stream0=data, Stream1=merge_2)

# ---- group: Collect references and lines and creates dimension (continued)
data_5 = Data(stream_filter)
merge_3 = Merge(Data1=simplify(graft(data_5)), Data2=data_3)  # -> simplify(Result)

# ----
cluster = Cluster(data=merge_3)  # -> simplify(data_5)

# ---- group: Collect references and lines and creates dimension (continued)
a_dim = AddAlignedDimension(View=simplify(graft(view)), References=cluster, Line=line_12, Type=type)

# ----
panel_2 = Panel(a_dim)  # disabled

# ---- group: Collect references and lines and creates dimension
view_2 = View(a_view)
data_6 = Data(item_11)
type_2 = Type(param.Element)
line_13 = Line(line_7)

# ---- group: DIM TO SIDE-FINDS SIDE REFERENCE (continued)
project_9 = Project(Geometry=deconstruct_plane_6.Origin, Plane=view_2)  # -> Geometry, Transform
curve_closest_point_2 = CurveClosestPoint(Point=project_9.Geometry, Curve=line_10)  # -> Point, Parameter, Distance
sort_list_2 = SortList(Keys=curve_closest_point_2.Distance, ValuesValuesA=face_6, ValuesA=curve_closest_point_2.Point)  # -> Keys, ValuesValuesA, ValuesA
list_item_2 = ListItem(List=sort_list_2.ValuesValuesA, Index=0, Wrap=True)  # -> flatten(Item)

# ----
data_7 = Data(list_item_2)
null_item_4 = NullItem(Item=list_item_2)  # -> NullFlags, InvalidFlags, Description
cull_pattern_9 = CullPattern(List=simplify(graft(data_2)), CullPattern=simplify(graft(null_item_4.NullFlags)))
cull_pattern_10 = CullPattern(List=simplify(graft(data_7)), CullPattern=invert(simplify(graft(null_item_4.NullFlags))))
merge_4 = Merge(Data1=cull_pattern_9, Data2=cull_pattern_10)  # -> flatten(Result)
stream_filter_2 = StreamFilter(Gate=boolean_toggle, Stream0=data_2, Stream1=merge_4)

# ---- group: Collect references and lines and creates dimension (continued)
data_8 = Data(stream_filter_2)
merge_5 = Merge(Data1=simplify(graft(data_8)), Data2=data_6)
a_dim_2 = AddAlignedDimension(View=simplify(graft(view_2)), References=merge_5, Line=line_13, Type=type_2)

# ----
panel_3 = Panel(a_dim_2)  # disabled

# ==== cluster Cluster
data = ClusterInput()

# ---- group: Tree to main index
data_2 = Data(data)
clean = CleanTree(RemoveNulls=True, RemoveInvalid=True, RemoveEmpty=True, Tree=data_2)
data_3 = Data(clean)

# ---- group: Tree to main index / Gets main index from path
tstat = TreeStatistics(Tree=clean)  # -> Paths, Length, Count
split = TextSplit(Text=tstat.Paths, Separators=";")  # -> simplify(Result)
item = ListItem(List=split, Index=0, Wrap=True)
concat = Concatenate(FragmentA=item, FragmentB="}")
rep = ReplaceText(Text=concat, Find="}}", Replace="}", RecursiveReplace=False)
dup = DuplicateData(Data=rep, Number=simplify(graft(tstat.Length)), Order=True)  # -> flatten(Data)

# ---- group: Tree to main index (continued)
tree = CreateTree(Data=data_3, Path=dup)
data_4 = Data(tree)

# ----
data_5 = ClusterOutput(data_4)
