# Grasshopper definition 24_AdvFilter.gh (Grasshopper 1.0.8)
# plug-ins: treesloth01, Rhino.Inside for Autodesk Revit, MetaHopper, Wombat

doubleclick = BooleanToggle(False)
dss_annotation_panel = Panel("Help on WhiteWork")
# Segment
# group modules into larger coherent parts
dss_log_v5_2 = PythonScript(Help=doubleclick)  # inputs Help: Boolean
# ---------- dss_log_v5_2: Python ----------
"""
Set grasshopper template and provide easy acces to Help file in intranet

"""

"""
Credits:
    20211117
    Created by Vladimir Ondejcik
    White arkitekter AB

Based on:
    WOMBAT version <0.0.1>
    Script by <Brian Ringley>
        def libraries() by <Giulio Piacentino> see <http://www.grasshopper3d.com/forum/topics/gh-filename-is-python>
        def writeToFile() by <Data Analytics Society> see <https://www.youtube.com/watch?v=-TF3mXhnCDw>
    Script version <15 September 2015> 
    Copyright <Creative Commons Sharealike>
"""


#add dsearch default path located on cad.local
import sys
new_path = r"\\sesthfs02\DSEARCH\REPOSITORY\Grasshopper\Xtras\DsearchCode"
if new_path not in sys.path: sys.path.append(new_path)

#import dsearch plugin
import dsearch as ds

import os

print sys.path

#reload module (this has use when working on module)
#reload(ds.DS_Log)
#reload(ds.DS_Links)

#setup template
template=ds.DS_Links.Template
ds.DS_Log.DS_Template(template)

#run help from module 
if Help:
    helpLink=ds.DS_Links.HelpLink
    ds.DS_Log.DS_Help(helpLink)

    #turn toggle back to false
    obj=ghenv.Component.Params.Input[0].Sources[0]
    obj.Value=False
    obj.ExpireSolution(True)
# ---------- end dss_log_v5_2 ----------

dss_projectnumber = Panel("0000")
# DSS_Author: Staffan Linné
# Staffan.Linne@white.se
dss_projectname = Panel("name")

# ----
# Organization of Grasshopper scripts at White:
# Script should be created and annotated always with notion that other person will need to use/edit them.
# Build your script in modules and segments, use color coding and annotation according this template.
# This standard should be applied to all scripts, big or small.
# 
# Read  guide on white work:
# "https://work.white.se/grasshopper-developer-guide/"
# For Advanced users:
# For design scripts running more than a month use "dsInitialize" and "dsScriptLog" functions on Dsearch tab to log changes over time.
dss_annotation_panel_2 = Panel("""Tip of a day:
You can change default colour grups by right clicking
Graphical templates are located on "Dsearch" tab""")
# GRAPHIC
# STANDARD
# In
# data and geometry import from rhino or external platforms
image_sampler = ImageSampler(dss_annotation_panel_2, Filter="Colour", Interpolate=False, Umax=1, Umin=0, Vmax=1, Vmin=0, Wrap=0)

# ---- group: Get union filter.... - First colour...
boolean_toggle = BooleanToggle(False)

# ----
enable_disable_object = EnableDisableObject(Enabled=Toggle(False), AllObjects_Object=[text_5, value_picker_2])

# ----
# 5. Create filters
button = Button()
enable_disable_object_2 = EnableDisableObject(
    Enabled=button,
    AllObjects_Object=[rulefilt, a_view_2, filters_2, fg_overrides, inspect_element, identity_6, stream_filter_10, filters, merge_2, boolean_9, null_item, boolean_10, view, category_3])

# ---- group: Values in project (True) - Value in view(False)
# 3. Parameter values for project or for view
boolean_toggle_2 = BooleanToggle(False)

# ---- group: False: Write parameter name True: Choose parameter in dropdown list
toggle = BooleanToggle(False)

# ----
# User Interface: I/O
# 1. Select a object in the active view (in the revit window)
# with the right category
active_selection = GraphicalElement()
graphical_element = GraphicalElement(active_selection)

boolean = Boolean(boolean_toggle)

graphical_element_2 = GraphicalElement(active_selection)
e_category = ElementCategory(Element=graphical_element_2)  # -> Element, Category
identity = CategoryIdentity(Category=e_category.Category)  # -> Name, IsSubcategory
category = Panel(identity.Name)

# ----
# Control
# General
# Monitor
# Out
# variable parameters and script execution
# (sliders, boolean togggle, text input,...)
# monitor data and geometry preview (used for panels for example)
# output data to rhino or external platforms
# WIP
# Annotation
# Plugin
# general annotation and notes
# textbased scripting and special plugins
# f.ex: HumanUI, kangaroo,...
# problematic or under repair or construction
dss_annotation_panel_3 = Panel("general development modules")

# ----
# Get Object parameters
graphical_element_3 = GraphicalElement(flatten(active_selection))
e_type = ElementType(Element=graphical_element_3)  # -> Element, Type
parameters = QueryElementParameters(Element=e_type.Type)
parameters_2 = QueryElementParameters(Element=e_type.Type, ReadOnly=False)
parameters_3 = QueryElementParameters(Element=graphical_element_3)
parameters_4 = QueryElementParameters(Element=graphical_element_3, ReadOnly=False)

cset = CreateSet(List=[parameters_3, parameters_4, parameters, parameters_2])  # -> Set, Map

parameter = Parameter(cset.Set)

# ---- group: 1: Select parameter
parameter_2 = Parameter(parameter)
value_picker = ValuePicker(parameter_2, SearchPattern="Type Mark")

# ----
# 2. Select a parameter by name
_0_write_parameter_name = Panel("Type Mark")
identity_2 = ParameterIdentity(Parameter=flatten(value_picker))  # -> Guid, Name, Type, Group
filter = StreamFilter(Gate=toggle, Stream0=_0_write_parameter_name, Stream1=identity_2.Name)
txt = Text(filter)
text = Text(txt)
instance_parameter = Panel(text)
text_2 = Text(txt)

# ----
# Colours
white_färger_bakgrund = Panel("""249, 164, 216
133, 216, 200
216, 121, 135
175, 168, 157
99, 208, 90
255, 199, 44
185, 158, 178
0, 125, 153
149, 88, 100
105, 124, 125
89, 119, 101
246, 80, 88""")

# ---- group: Färger för objekt
colour = Colour(white_färger_bakgrund)
shift_list = ShiftList(List=colour, Shift=Slider(0, range=0..10), Wrap=True)

# ---- group: Random colours
list_length = ListLength(List=white_färger_bakgrund)

# ----
colour_2 = Colour(shift_list)

# ----
# Parameters and parameter values
boolean_2 = Boolean(boolean_toggle_2)
graphical_element_4 = GraphicalElement(graphical_element)

# ---- group: Type or instance parameter
text_3 = Text(text_2)
query_element_parameters = QueryElementParameters(Element=graphical_element_4)
e_type_2 = ElementType(Element=graphical_element_4)  # -> Element, Type
query_element_parameters_2 = QueryElementParameters(Element=e_type_2.Type)
identity_3 = ParameterIdentity(Parameter=query_element_parameters)  # -> Guid, Name, Type, Group
identity_4 = ParameterIdentity(Parameter=query_element_parameters_2)  # -> Guid, Name, Type, Group
member_index = MemberIndex(Set=identity_3.Name, Member=text_3)  # -> Index, Count
member_index_2 = MemberIndex(Set=identity_4.Name, Member=text_3)  # -> Index, Count
list_item = ListItem(List=query_element_parameters, Index=member_index.Index, Wrap=True)
list_item_2 = ListItem(List=query_element_parameters_2, Index=member_index_2.Index, Wrap=True)

# ---- group: Category
e_category_2 = ElementCategory(Element=graphical_element_4)  # -> Element, Category
identity_5 = CategoryIdentity(Category=e_category_2.Category)  # -> Discipline, Type, Name, IsVisibleUI, IsSubcategory
create_set = CreateSet(List=e_category_2.Category)  # -> Set, Map
text_4 = Text(identity_5.Name)
category_2 = Category(create_set.Set)

# ----
stream_gate = StreamGate(Stream=e_category_2.Category, Gate=boolean_2)  # -> Target0, Target1
list_length_2 = ListLength(List=list_item_2)

# ---- group: All elements in project
category_filter = CategoryFilter(Categories=stream_gate.Target1, Inverted=False)
elements = QueryElements(Filter=category_filter)  # -> Elements, Count
e_type_3 = ElementType(Element=elements.Elements)  # -> Element, Type
type = Type(e_type_3.Type)
graphical_element_5 = GraphicalElement(e_type_3.Element)

# ---- group: Elements in view
category_filter_2 = CategoryFilter(Categories=stream_gate.Target0, Inverted=False)
a_view = ActiveView()
v_elements = QueryViewElements(View=a_view, Filter=category_filter_2)
e_type_4 = ElementType(Element=v_elements)  # -> Element, Type
graphical_element_6 = GraphicalElement(e_type_4.Element)
type_2 = Type(e_type_4.Type)

# ---- group: Parameter values for name and colour
graphical_element_7 = GraphicalElement([graphical_element_6, graphical_element_5])
parameter_3 = Parameter(list_item_2)
type_3 = Type([type_2, type])
parameter_4 = Parameter(list_item)
param = ElementParameter(Element=graphical_element_7, Parameter=parameter_4)  # -> Element, Value
param_2 = ElementParameter(Element=type_3, Parameter=parameter_3)  # -> Element, Value
boolean_3 = Boolean(invert(list_length_2))
stream_filter = StreamFilter(Gate=boolean_3, Stream0=param_2.Value, Stream1=param.Value)

# ----
# 4. To create filter only for specific parameter values
# - switch to true
# - pick specific values in value picker
text_5 = Text(stream_filter)  # disabled
value_picker_2 = ValuePicker(text_5)  # disabled

# ---- group: Pick specific parameter values
text_6 = Text(value_picker_2)
list_length_3 = ListLength(List=text_6)
boolean_4 = Boolean(list_length_3)
addition = Addition(A=boolean_4, B=Slider(0, range=0..100))

# ---- group: Color on fpr panel
list_length_4 = ListLength(List=stream_filter)
boolean_5 = Boolean(invert(list_length_2))
boolean_6 = Boolean(list_length_4)
get_connected_objects = GetConnectedObjects(Objects=instance_parameter)
stream_filter_2 = StreamFilter(Gate=boolean_6, Stream0=ColourSwatch(SwatchColor=RGB(255, 0, 0)), Stream1=ColourSwatch(SwatchColor=RGB(72, 165, 0)))
stream_filter_3 = StreamFilter(Gate=boolean_5, Stream0="Type Parameter", Stream1="Instance parameter")
set_panel_properties = SetPanelProperties(Panel=get_connected_objects, NickName=stream_filter_3, Color=stream_filter_2, AllObjects_Object=instance_parameter)

# ----
stream_filter_4 = StreamFilter(Gate=addition, Stream0=stream_filter, Stream1=text_6)

# ---- group: Parameter values for name and colour (continued)
create_set_2 = CreateSet(List=stream_filter_4)  # -> Set, Map
member_index_3 = MemberIndex(Set=create_set_2.Set, Member=create_set_2.Set)  # -> flatten(Index), Count

# ---- group: Random colours (continued)
list_length_5 = ListLength(List=member_index_3.Index)
subtraction = Subtraction(A=list_length_5, B=list_length)
series = Series(Start=0, Step=1, Count=subtraction)
random_color = RandomColor(Data=series, Seed=Slider(10, range=0..10), FastMode=False)
extra_färger = Panel(random_color)

# ----
integer = Integer(member_index_3.Index)
larger_than = LargerThan(FirstNumber=list_length_5, SecondNumber=list_length)  # -> LargerThan, OrEqualTo
list_item_3 = ListItem(List=colour_2, Index=integer, Wrap=True)  # -> simplify(graft(Item))
stream_filter_5 = StreamFilter(Gate=larger_than.LargerThan, Stream1=extra_färger)
stream_filter_6 = StreamFilter(Gate=larger_than.LargerThan, Stream0=list_item_3, Stream1=colour_2)
merge = Merge(Data1=flatten(stream_filter_6), Data2=flatten(stream_filter_5))  # -> simplify(graft(Result))
colour_3 = Colour(merge)
text_7 = Text(create_set_2.Set)
legend = Legend(Colour=flatten(colour_3), Tags=text_7, LegendType=1)

# ----
# Filters to be created (Zoom)
text_8 = Text(create_set_2.Set)
colour_4 = Colour(merge)
legend_2 = Legend(Colour=flatten(colour_4), Tags=text_8, LegendType=1)

# ---- group: Parameter value filters
boolean_7 = Boolean(invert(list_length_2))
parameter_5 = Parameter(list_item_2)
parameter_6 = Parameter(list_item)
stream_filter_7 = StreamFilter(Gate=boolean_7, Stream0=parameter_5, Stream1=parameter_6)
equals_rule = EqualsRule(Parameter=stream_filter_7, Value=create_set_2.Set)  # -> simplify(graft(Rule))
parameter_filter = ParameterFilter(Rules=equals_rule, Inverted=False)

# ---- group: Filter Name
text_9 = Text(text_4)
concatenate = Concatenate(FragmentA=text_9, FragmentB=create_set_2.Set, JoinSeparator="_")

# ----
text_join = TextJoin(Text=create_set_2.Set, Join="_")

# ---- group: Filter Name
text_10 = Text(text_4)
concatenate_2 = Concatenate(FragmentA=text_10, FragmentB=text_join, JoinSeparator="_")

# ---- group: Union filter
union_filter = UnionFilter(Filters=flatten(parameter_filter))
boolean_8 = Boolean(boolean)
stream_filter_8 = StreamFilter(Gate=boolean_8, Stream0=parameter_filter, Stream1=union_filter)

# ----
stream_filter_9 = StreamFilter(Gate=boolean_8, Stream0=concatenate, Stream1=concatenate_2)

# ---- group: Filter graphics override
fill_patterns = QueryFillPatterns(Name="?Solid", Type=0)
list_item_4 = ListItem(List=fill_patterns, Index=0, Wrap=True)
colour_5 = Colour(merge)
g_overrides = GraphicOverrides(
    ColorProjectionLines=colour_5,
    ForegroundPatternSurfacePatterns=list_item_4,
    ForegroundColorSurfacePatterns=colour_5,
    BackgroundPatternSurfacePatterns=list_item_4,
    BackgroundColorSurfacePatterns=colour_5,
    ForegroundVisibleCutPatterns=Toggle(True),
    ForegroundPatternCutPatterns=list_item_4,
    ForegroundColorCutPatterns=colour_5)  # -> simplify(graft(Overrides))

# ----
category_3 = Category(category_2)  # disabled
# Filter Creations
a_view_2 = ActiveView()  # disabled
rulefilt = AddRuleBasedFilter(Name=simplify(graft(stream_filter_9)), Categories=category_3, Filter=stream_filter_8, FailureProcessingMode=1)  # disabled

# ---- group: Cheking if view has view template or not
inspect_element = InspectElement(Element=a_view_2)  # disabled
view = View(inspect_element)  # disabled
identity_6 = ViewIdentity(View=view)  # -> Discipline, ViewFamily, ViewName, IsDependent, ViewDependency, IsTemplate, ViewTemplate, IsAssembly, AssociatedAssembly, IsPrintable; disabled
boolean_9 = Boolean(identity_6.IsTemplate)  # disabled
null_item = NullItem(Item=boolean_9)  # -> NullFlags, InvalidFlags, Description; disabled
boolean_10 = Boolean(invert(null_item.NullFlags))  # disabled
stream_filter_10 = StreamFilter(Gate=boolean_10, Stream0=a_view_2, Stream1=inspect_element)  # disabled

# ----
renumber_paths = RenumberPaths(Data=rulefilt)
tree_statistics = TreeStatistics(Tree=simplify(renumber_paths))  # -> Paths, Length, Count
list_length_6 = ListLength(List=tree_statistics.Paths)
tree_branch = TreeBranch(Tree=g_overrides, Path=tree_statistics.Paths, MaintainPaths=True)
subtraction_2 = Subtraction(A=list_length_6, B="1")

# ---- group: Adding filter to filter list
filters = ViewFilters(View=stream_filter_10)  # -> View, Filters; disabled

# ----
boolean_11 = Boolean(subtraction_2)
stream_filter_11 = StreamFilter(Gate=boolean_11, Stream0=g_overrides, Stream1=tree_branch)

merge_2 = Merge(Data1=filters.Filters, Data2=flatten(rulefilt))  # -> flatten(Result); disabled
filters_2 = ViewFilters(View=stream_filter_10, Filters=merge_2, FailureProcessingMode=1)  # -> View, Filters; disabled
fg_overrides = FilterGraphicOverrides(View=filters_2.View, Filter=rulefilt, Overrides=stream_filter_11)  # -> View, Filter, Hidden, Overrides; disabled
