# Grasshopper definition 30_Hide_Show_Colour.gh (Grasshopper 1.0.8)
# plug-ins: Rhino.Inside for Autodesk Revit

doubleclick = BooleanToggle(False)
dss_annotation_panel = Panel("Help on WhiteWork")
# Segment
# group modules into larger coherent parts
# User Interface: I/O
dss_log_v5_2 = PythonScript(Help=doubleclick)  # inputs Help: Boolean
# ---------- dss_log_v5_2: Python ----------
"""
Set grasshopper template and provide easy acces to Help file in intranet

"""

"""
Credits:
    20211117
    Created by Vladimir Ondejcik
    White arkitekter AB

Based on:
    WOMBAT version <0.0.1>
    Script by <Brian Ringley>
        def libraries() by <Giulio Piacentino> see <http://www.grasshopper3d.com/forum/topics/gh-filename-is-python>
        def writeToFile() by <Data Analytics Society> see <https://www.youtube.com/watch?v=-TF3mXhnCDw>
    Script version <15 September 2015> 
    Copyright <Creative Commons Sharealike>
"""


#add dsearch default path located on cad.local
import sys
new_path = r"\\sesthfs02\DSEARCH\REPOSITORY\Grasshopper\Xtras\DsearchCode"
if new_path not in sys.path: sys.path.append(new_path)

#import dsearch plugin
import dsearch as ds

import os

print sys.path

#reload module (this has use when working on module)
#reload(ds.DS_Log)
#reload(ds.DS_Links)

#setup template
template=ds.DS_Links.Template
ds.DS_Log.DS_Template(template)

#run help from module 
if Help:
    helpLink=ds.DS_Links.HelpLink
    ds.DS_Log.DS_Help(helpLink)

    #turn toggle back to false
    obj=ghenv.Component.Params.Input[0].Sources[0]
    obj.Value=False
    obj.ExpireSolution(True)
# ---------- end dss_log_v5_2 ----------

dss_tags = Panel("tags, tags")
dss_description = Panel("description")

# ----
# PROJECT INFO
dss_projectnumber = Panel("0000")
dss_projectname = Panel("name")

# ----
# Organization of Grasshopper scripts at White:
# Script should be created and annotated always with notion that other person will need to use/edit them.
# Build your script in modules and segments, use color coding and annotation according this template.
# This standard should be applied to all scripts, big or small.
# 
# Read  guide on white work:
# "https://work.white.se/grasshopper-developer-guide/"
# READ ME
# For Advanced users:
# For design scripts running more than a month use "dsInitialize" and "dsScriptLog" functions on Dsearch tab to log changes over time.
dss_annotation_panel_2 = Panel("""Tip of a day:
You can change default colour grups by right clicking
Graphical templates are located on "Dsearch" tab""")
# GRAPHIC
# STANDARD
# In
# data and geometry import from rhino or external platforms
image = ImageSampler(dss_annotation_panel_2, Filter="Colour", Interpolate=False, Umax=1, Umin=0, Vmax=1, Vmin=0, Wrap=0)

# ---- group: Colour (Red)
text = Text("255,0,0")
panel = Panel(text)

# ----
boolean_toggle = BooleanToggle(True)
a_view = ActiveView()

match_text = MatchText(Text=a_view, RegEx="Sheet", Case=True)
cull_pattern = CullPattern(List=a_view, CullPattern=match_text)
sheet = Sheet(cull_pattern)
vports = QueryViewports(Sheet=sheet)

panel_2 = Panel("""Schedule
Elevation
Legend
3D View
Section
Floor Plan
Section
Area Plan
Area Plan
Ceiling Plan
Section
Detail View
Drafting View""")
types = QueryTypes(Kind=3, FamilyName=panel_2)  # -> flatten(Types)
cset = CreateSet(List=types)  # -> Set, Map
typefltr = TypeFilter(Types=cset.Set, Inverted=False)
filtelem = FilterElements(Elements=vports, Filter=typefltr)
cull = CullPattern(List=vports, CullPattern=invert(filtelem))

# ----
# Control
# General
# Monitor
# Out
# variable parameters and script execution
# (sliders, boolean togggle, text input,...)
# monitor data and geometry preview (used for panels for example)
# output data to rhino or external platforms
# WIP
# Annotation
# Plugin
# general annotation and notes
# textbased scripting and special plugins
# f.ex: HumanUI, kangaroo,...
# problematic or under repair or construction
# Back-end
dss_annotation_panel_3 = Panel("general development modules")

view = View(cull)

# ---- group: Views på sheets / Workset hack for views
workset = ElementWorkset(Element=view)  # -> Element, Workset, Status
workset_2 = WorksetIdentity(Workset=workset.Workset)  # -> Kind, Name, Owner, Open, Editable, Visible
worksets = QueryWorksets(Kind=2)
workset_3 = WorksetIdentity(Workset=worksets)  # -> Kind, Name, Owner, Open, Editable, Visible
match_text_2 = MatchText(Text=workset_3.Name, Pattern=simplify(graft(workset_2.Name)), Case=True)
cull_pattern_2 = CullPattern(List=worksets, CullPattern=match_text_2)  # -> simplify(List)
list_item = ListItem(List=cull_pattern_2, Index=Slider(1, range=0..1), Wrap=True)

# ---- group: I view / Workset hack for views
workset_4 = ElementWorkset(Element=a_view)  # -> Element, Workset, Status
workset_5 = WorksetIdentity(Workset=workset_4.Workset)  # -> Kind, Name, Owner, Open, Editable, Visible
worksets_2 = QueryWorksets(Kind=2)
workset_6 = WorksetIdentity(Workset=worksets_2)  # -> Kind, Name, Owner, Open, Editable, Visible
match_text_3 = MatchText(Text=workset_6.Name, Pattern=workset_5.Name, Case=True)
cull_pattern_3 = CullPattern(List=worksets_2, CullPattern=match_text_3)
list_item_2 = ListItem(List=cull_pattern_3, Index=Slider(1, range=0..1), Wrap=True)

# ----
categories = QueryCategories(Type=1, Name="Detail Items", IsVisibleUI=True, IsSubcategory=False)

# ---- group: I view
workset_7 = Workset(list_item_2)
workset_filter = WorksetFilter(Workset=workset_7, Inverted=False)
workset_8 = Workset(list_item_2)
workset_filter_2 = WorksetFilter(Workset=workset_8, Inverted=False)

# ---- group: I view / Lines
categories_2 = QueryCategories(Type=1, Name="Lines", IsSubcategory=False)
category_filter = CategoryFilter(Categories=categories_2, Inverted=False)
logical_and_filter = LogicalAndFilter(FilterA=category_filter, FilterB=workset_filter)

# ----
workset_9 = Workset(list_item_2)
workset_filter_3 = WorksetFilter(Workset=workset_9, Inverted=False)
visfltr = VisibleInViewFilter(View=a_view, Inverted=False)

# ---- group: I view / Texts
text_2 = Text("autodesk.revit.category.local:textNotes")
panel_3 = Panel(text_2)
category_filter_2 = CategoryFilter(Categories=panel_3, Inverted=False)
logical_and_filter_2 = LogicalAndFilter(FilterA=category_filter_2, FilterB=workset_filter_2)

# ---- group: Texts
text_3 = Text("autodesk.revit.category.local:textNotes")
panel_4 = Panel(text_3)
category_filter_3 = CategoryFilter(Categories=categories, Inverted=False)
logical_and_filter_3 = LogicalAndFilter(FilterA=category_filter_3, FilterB=workset_filter_3)

# ---- group: I view / Lines
categories_3 = QueryCategories(Type=2, Name="Dimensions", IsSubcategory=False)

workset_10 = Workset(list_item_2)
workset_filter_4 = WorksetFilter(Workset=workset_10, Inverted=False)
category_filter_4 = CategoryFilter(Categories=categories_3, Inverted=False)
logical_and_filter_4 = LogicalAndFilter(FilterA=category_filter_4, FilterB=workset_filter_4)

# ---- group: Views på sheets / Lines
categories_4 = QueryCategories(Type=2, Name="Dimensions", IsSubcategory=False)

workset_11 = Workset(list_item)
workset_filter_5 = WorksetFilter(Workset=workset_11, Inverted=False)
category_filter_5 = CategoryFilter(Categories=categories_4, Inverted=False)
logical_and_filter_5 = LogicalAndFilter(FilterA=category_filter_5, FilterB=workset_filter_5)  # -> simplify(Filter)

# ---- group: Views på sheets / Texts
categories_5 = QueryCategories(Type=2, Name="Text Notes", IsSubcategory=False)
category_filter_6 = CategoryFilter(Categories=categories_5, Inverted=False)

# ---- group: Views på sheets / Lines
categories_6 = QueryCategories(Type=1, Name="Lines", IsSubcategory=False)
category_filter_7 = CategoryFilter(Categories=categories_6, Inverted=False)

# ---- group: Views på sheets
workset_12 = Workset(list_item)
workset_filter_6 = WorksetFilter(Workset=workset_12, Inverted=False)
workset_13 = Workset(list_item)
workset_filter_7 = WorksetFilter(Workset=workset_13, Inverted=False)
relay = Relay()

# ----
panel_5 = Panel(workset_12)

# ---- group: Views på sheets / Lines (continued)
logical_and_filter_6 = LogicalAndFilter(FilterA=category_filter_7, FilterB=workset_filter_6)  # -> simplify(Filter)

# ---- group: I view / Lines
elements = QueryElements(Filter=logical_and_filter_4, Limit=120000)  # -> Elements, Count

elements_2 = QueryElements(Filter=logical_and_filter, Limit=120000)  # -> Elements, Count
inspect_element = InspectElement(Element=elements_2.Elements)

catstyle = CategoryStyle(Category=inspect_element)  # -> Category, LineWeight_projection, LineWeight_cut, LineColor, LinePattern_projection, Material

# ----
text_4 = Text(catstyle.LineColor)

# ---- group: Texts
elements_3 = QueryElements(Filter=logical_and_filter_3, Limit=120000)  # -> Elements, Count

# ---- group: I view / Texts
elements_4 = QueryElements(Filter=logical_and_filter_2, Limit=120000)  # -> Elements, Count

e_type = ElementType(Element=elements_4.Elements)  # -> Element, Type
inspect_element_2 = InspectElement(Element=e_type.Type)

# ---- group: Texts
e_type_2 = ElementType(Element=elements_3.Elements)  # -> Element, Type
inspect_element_3 = InspectElement(Element=e_type_2.Type)

# ---- group: I view / Lines
e_type_3 = ElementType(Element=elements.Elements)  # -> Element, Type
inspect_element_4 = InspectElement(Element=e_type_3.Type)

# ----
text_5 = Text(inspect_element_4)

# ---- group: Views på sheets / Texts (continued)
logical_and_filter_7 = LogicalAndFilter(FilterA=category_filter_6, FilterB=workset_filter_7)

# ---- group: Views på sheets / Lines
elements_5 = QueryElements(Filter=logical_and_filter_6, Limit=120000)  # -> Elements, Count
inspect_element_5 = InspectElement(Element=elements_5.Elements)

elements_6 = QueryElements(Filter=logical_and_filter_5, Limit=120000)  # -> Elements, Count

# ---- group: Views på sheets / Texts
elements_7 = QueryElements(Filter=logical_and_filter_7, Limit=120000)  # -> Elements, Count

# ---- group: Texts (continued)
text_6 = Text(inspect_element_3)

# ---- group: Views på sheets (continued)
e_type_4 = ElementType(Element=elements_6.Elements)  # -> Element, Type
inspect_element_6 = InspectElement(Element=e_type_4.Type)
text_7 = Text(inspect_element_6)

# ---- group: I view / Texts (continued)
text_8 = Text(inspect_element_2)

# ---- group: Views på sheets / Lines
catstyle_2 = CategoryStyle(Category=inspect_element_5)  # -> Category, LineWeight_projection, LineWeight_cut, LineColor, LinePattern_projection, Material

# ----
text_9 = Text(catstyle_2.LineColor)

# ---- group: Views på sheets / Texts (continued)
e_type_5 = ElementType(Element=elements_7.Elements)  # -> Element, Type
inspect_element_7 = InspectElement(Element=e_type_5.Type)  # -> simplify(GraphicsColor)

# ----
text_10 = Text(inspect_element_7)
txt = Text(flatten([text_5, text_4, text_8, text_7, text_9, text_10, text_6]))
cset_2 = CreateSet(List=txt)  # -> Set, Map
mindex = MemberIndex(Set=cset_2.Set, Member=panel)  # -> Index, Count
col = Colour(cset_2.Set)
valur_list_with_bool_values = Python3Script(
    Items=cset_2.Set,
    ItemColors=col,
    Title="Choose colour to show/hide",
    PreselectIndices=mindex.Index,
    ToggleTrueLabel="Show",
    ToggleFalseLabel="Hide")  # -> out, SelectedItems, ToggleValue; inputs Items: list, ItemColors: list, PreselectIndices: list of Int32
# ---------- valur_list_with_bool_values: Python ----------
"""
GhPython: ListBox selection dialog with Enter/Escape keyboard shortcuts for Rhino.Inside.Revit

Inputs:
  Items (list)            - list of objects to display (display uses str(obj))
  Title (str)             - optional dialog title (default "Select items")
  AllowMulti (bool)       - optional, allow multiple selection (default True)
  PreselectIndices (list) - optional zero-based indices to preselect (default [])
    ItemColors (list)       - optional list of colors per item (default [])
    ToggleFalseLabel (str)  - optional label for False option (default "No")
    ToggleTrueLabel (str)   - optional label for True option (default "Yes")
    ToggleDefault (bool)    - optional default value for toggle (default False)
  Width (int)             - optional dialog width (default 420)
  Height (int)            - optional dialog height (default 340)

Outputs:
  SelectedItems (list) - list of selected original items (empty if none or Cancel)
  Result (str)         - "OK" or "Cancel"
    ToggleValue (bool)   - boolean toggle value (False if Cancel)
"""

import clr
import System

# Add WinForms references
clr.AddReference("System.Windows.Forms")
clr.AddReference("System.Drawing")

from System.Windows.Forms import Form, ListBox, Button, AnchorStyles, DialogResult, Label, FormStartPosition, SelectionMode, RadioButton, DrawMode
from System.Drawing import Size, Point, Font, FontStyle, Color

# Input validation and defaults
def validate_input(var_name, default_value, expected_type=None):
    """Safely get input variable with default fallback"""
    try:
        value = globals().get(var_name, default_value)
        if value is None:
            return default_value
        if expected_type and not isinstance(value, expected_type):
            return default_value
        return value
    except:
        return default_value

# Validate all inputs
Items = validate_input('Items', [], list)
Title = validate_input('Title', "Select items", str)
AllowMulti = validate_input('AllowMulti', True, bool)
PreselectIndices = validate_input('PreselectIndices', [], list)
ItemColors = validate_input('ItemColors', [], list)
ToggleFalseLabel = validate_input('ToggleFalseLabel', "No", str)
ToggleTrueLabel = validate_input('ToggleTrueLabel', "Yes", str)
ToggleDefault = validate_input('ToggleDefault', False, bool)
Width = validate_input('Width', 420, int)
Height = validate_input('Height', 340, int)

# Ensure Width and Height are reasonable
Width = max(300, min(1200, Width))
Height = max(200, min(800, Height))

def show_listbox_dialog(items, title="Select items", allow_multi=True, preselect=None, item_colors=None, toggle_false_label="No", toggle_true_label="Yes", toggle_default=False, width=420, height=340):
    """
    Show modal dialog with a ListBox. Supports Enter->OK and Escape->Cancel.
    Returns (selected_original_items_list, result_str) where result_str is "OK" or "Cancel".
    """
    preselect = preselect or []
    original_items = list(items) if items is not None else []
    
    # Handle empty items list
    if not original_items:
        return [], "Cancel", False
    
    display_strings = [str(it) for it in original_items]
    item_colors = item_colors or []

    def normalize_color(c):
        try:
            if isinstance(c, Color):
                return c
            if isinstance(c, (list, tuple)) and len(c) >= 3:
                r, g, b = int(c[0]), int(c[1]), int(c[2])
                r = max(0, min(255, r))
                g = max(0, min(255, g))
                b = max(0, min(255, b))
                return Color.FromArgb(r, g, b)
        except:
            pass
        return None

    # Build form
    form = Form()
    form.Text = str(title)
    form.Size = Size(width, height)
    form.StartPosition = FormStartPosition.CenterScreen
    form.MinimizeBox = False
    form.MaximizeBox = False
    form.FormBorderStyle = System.Windows.Forms.FormBorderStyle.FixedDialog
    form.ShowInTaskbar = False
    form.KeyPreview = True  # capture key presses at the form level

    # Label
    label = Label()
    label.Text = "Select items and press Enter to confirm, or Esc to cancel."
    label.AutoSize = False
    label.Size = System.Drawing.Size(width - 40, 20)
    label.Location = Point(10, 10)
    form.Controls.Add(label)

    # ListBox
    lb = ListBox()
    lb.Size = Size(width - 40, height - 150)
    lb.Location = Point(10, 40)
    lb.Anchor = AnchorStyles.Top | AnchorStyles.Bottom | AnchorStyles.Left | AnchorStyles.Right
    # Selection mode
    lb.SelectionMode = SelectionMode.MultiExtended if allow_multi else SelectionMode.One
    lb.DrawMode = DrawMode.OwnerDrawFixed

    def on_draw_item(sender, e):
        try:
            e.DrawBackground()
            idx = e.Index
            if idx < 0:
                return
            text = lb.Items[idx]
            color = None
            if idx < len(item_colors):
                color = normalize_color(item_colors[idx])
            if color is None:
                color = e.ForeColor
            brush = System.Drawing.SolidBrush(color)
            e.Graphics.DrawString(str(text), e.Font, brush, e.Bounds)
            if (e.State & System.Windows.Forms.DrawItemState.Focus) == System.Windows.Forms.DrawItemState.Focus:
                e.DrawFocusRectangle()
        except:
            pass

    lb.DrawItem += on_draw_item

    # Fill listbox
    for ds in display_strings:
        lb.Items.Add(ds)
    form.Controls.Add(lb)

    # Toggle (boolean) below list - two options
    rb_false = RadioButton()
    rb_false.Text = str(toggle_false_label) if toggle_false_label is not None else "No"
    rb_false.AutoSize = True
    rb_false.Font = Font("Segoe UI", 11, FontStyle.Bold)
    rb_false.Location = Point(10, height - 115)
    rb_false.Anchor = AnchorStyles.Bottom | AnchorStyles.Left

    rb_true = RadioButton()
    rb_true.Text = str(toggle_true_label) if toggle_true_label is not None else "Yes"
    rb_true.AutoSize = True
    rb_true.Font = Font("Segoe UI", 11, FontStyle.Bold)
    rb_true.Location = Point(160, height - 115)
    rb_true.Anchor = AnchorStyles.Bottom | AnchorStyles.Left

    if bool(toggle_default):
        rb_true.Checked = True
    else:
        rb_false.Checked = True

    form.Controls.Add(rb_false)
    form.Controls.Add(rb_true)

    # Preselect indices if valid
    for idx in preselect:
        try:
            idx_int = int(idx)
            if 0 <= idx_int < lb.Items.Count:
                lb.SetSelected(idx_int, True)
        except:
            pass

    # Buttons
    btn_ok = Button()
    btn_ok.Text = "OK"
    btn_ok.Size = System.Drawing.Size(80, 28)
    btn_ok.Location = Point(width - 200, height - 80)
    btn_ok.Anchor = AnchorStyles.Bottom | AnchorStyles.Right

    def on_ok(sender, args):
        form.DialogResult = DialogResult.OK
        form.Close()
    btn_ok.Click += on_ok
    form.Controls.Add(btn_ok)

    btn_cancel = Button()
    btn_cancel.Text = "Cancel"
    btn_cancel.Size = System.Drawing.Size(80, 28)
    btn_cancel.Location = Point(width - 100, height - 80)
    btn_cancel.Anchor = AnchorStyles.Bottom | AnchorStyles.Right

    def on_cancel(sender, args):
        form.DialogResult = DialogResult.Cancel
        form.Close()
    btn_cancel.Click += on_cancel
    form.Controls.Add(btn_cancel)

    # Keyboard handling: Enter -> OK, Escape -> Cancel
    def on_key_down(sender, args):
        # args is System.Windows.Forms.KeyEventArgs
        try:
            if args.KeyCode == System.Windows.Forms.Keys.Enter:
                form.DialogResult = DialogResult.OK
                form.Close()
            elif args.KeyCode == System.Windows.Forms.Keys.Escape:
                form.DialogResult = DialogResult.Cancel
                form.Close()
        except Exception:
            # swallow exceptions from unexpected key handling
            pass

    form.KeyDown += on_key_down

    # Show modal
    res = form.ShowDialog()

    if res == DialogResult.OK:
        # Map selected indices back to original objects
        selected = []
        for i in range(lb.SelectedIndices.Count):
            idx = lb.SelectedIndices[i]
            try:
                selected.append(original_items[idx])
            except:
                selected.append(lb.Items[idx])
        return selected, "OK", bool(rb_true.Checked)
    else:
        return [], "Cancel", False

# Run dialog and set outputs
try:
    selected_items, result, toggle_value = show_listbox_dialog(Items, Title, AllowMulti, PreselectIndices, ItemColors, ToggleFalseLabel, ToggleTrueLabel, ToggleDefault, Width, Height)
except Exception as ex:
    selected_items, result, toggle_value = [], "Cancel", False
    print("Error showing selection dialog:", str(ex))

# Set Grasshopper outputs
SelectedItems = selected_items
Result = result
ToggleValue = toggle_value
# ---------- end valur_list_with_bool_values ----------
txt_2 = Text(valur_list_with_bool_values.SelectedItems)
lng = ListLength(List=txt_2)
len = TextLength(Text=txt_2)
bool = Boolean(lng)
filter = StreamFilter(Gate=bool, Stream1=valur_list_with_bool_values.ToggleValue)
bool_2 = Boolean(invert(filter))

# ---- group: I view / Lines (continued)
text_11 = Text(txt_2)

# ----
match_text_4 = MatchText(Text=simplify(graft(text_4)), RegEx=text_11, Case=True)

# ---- group: I view / Lines (continued)
text_12 = Text(txt_2)

# ----
match_text_5 = MatchText(Text=simplify(graft(text_5)), RegEx=text_12, Case=True)
ma = MassAddition(Input=match_text_4)  # -> Result, PartialResults

# ---- group: I view / Texts (continued)
text_13 = Text(txt_2)

# ----
ma_2 = MassAddition(Input=match_text_5)  # -> Result, PartialResults

# ---- group: Texts (continued)
text_14 = Text(txt_2)

# ---- group: I view / Lines (continued)
cull_pattern_4 = CullPattern(List=simplify(graft(elements_2.Elements)), CullPattern=ma.Result)  # -> flatten(List)
graphical_element = GraphicalElement(cull_pattern_4)

cull_pattern_5 = CullPattern(List=simplify(graft(elements.Elements)), CullPattern=ma_2.Result)  # -> flatten(List)
graphical_element_2 = GraphicalElement(cull_pattern_5)

# ----
text_15 = Text(txt_2)
text_16 = Text(txt_2)

# ---- group: Views på sheets (continued)
match_text_6 = MatchText(Text=simplify(graft(text_7)), RegEx=text_15, Case=True)

# ----
ma_3 = MassAddition(Input=match_text_6)  # -> Result, PartialResults
match_text_7 = MatchText(Text=simplify(graft(text_9)), RegEx=text_16, Case=True)
text_17 = Text(txt_2)

# ---- group: Views på sheets / Lines (continued)
cull_pattern_6 = CullPattern(List=simplify(graft(elements_6.Elements)), CullPattern=ma_3.Result)  # -> simplify(flatten(List))
graphical_element_3 = GraphicalElement(cull_pattern_6)

# ----
match_text_8 = MatchText(Text=simplify(graft(text_10)), RegEx=text_17, Case=True)
ma_4 = MassAddition(Input=match_text_7)  # -> Result, PartialResults

# ---- group: Views på sheets / Lines (continued)
cull_pattern_7 = CullPattern(List=simplify(graft(elements_5.Elements)), CullPattern=ma_4.Result)  # -> simplify(flatten(List))
graphical_element_4 = GraphicalElement(cull_pattern_7)

# ---- group: I view / Lines
curve_element = CurveElement(graphical_element)
eg_overrides = ElementGraphicOverrides(View=a_view, Element=curve_element, Hidden=bool_2, FailureProcessingMode=1)  # -> View, Element, Hidden, Overrides

# ----
ma_5 = MassAddition(Input=match_text_8)  # -> Result, PartialResults

# ---- group: Views på sheets / Texts (continued)
cull_pattern_8 = CullPattern(List=simplify(graft(elements_7.Elements)), CullPattern=ma_5.Result)  # -> flatten(List)
graphical_element_5 = GraphicalElement(simplify(cull_pattern_8))

# ---- group: I view / Lines (continued)
eg_overrides_2 = ElementGraphicOverrides(View=a_view, Element=graphical_element_2, Hidden=bool_2, FailureProcessingMode=1)  # -> View, Element, Hidden, Overrides

# ---- group: Views på sheets / Lines (continued)
curve_element_2 = CurveElement(graphical_element_4)
eg_overrides_3 = ElementGraphicOverrides(View=simplify(graft(view)), Element=curve_element_2, Hidden=bool_2, FailureProcessingMode=1)  # -> View, Element, Hidden, Overrides

eg_overrides_4 = ElementGraphicOverrides(View=simplify(graft(view)), Element=graphical_element_3, Hidden=bool_2, FailureProcessingMode=1)  # -> View, Element, Hidden, Overrides

# ---- group: Views på sheets / Texts (continued)
eg_overrides_5 = ElementGraphicOverrides(View=simplify(graft(view)), Element=graphical_element_5, Hidden=bool_2, FailureProcessingMode=1)  # -> View, Element, Hidden, Overrides

# ---- group: I view / Texts (continued)
match_text_9 = MatchText(Text=simplify(graft(text_8)), RegEx=text_13, Case=True)  # -> simplify(Match)

# ----
ma_6 = MassAddition(Input=match_text_9)  # -> Result, PartialResults
panel_6 = Panel(match_text_9)

# ---- group: I view / Texts (continued)
cull_pattern_9 = CullPattern(List=simplify(graft(elements_4.Elements)), CullPattern=simplify(ma_6.Result))  # -> flatten(List)
graphical_element_6 = GraphicalElement(cull_pattern_9)

eg_overrides_6 = ElementGraphicOverrides(View=a_view, Element=graphical_element_6, Hidden=bool_2, FailureProcessingMode=1)  # -> View, Element, Hidden, Overrides

# ---- group: Texts (continued)
match_text_10 = MatchText(Text=simplify(graft(text_6)), RegEx=text_14, Case=True)

# ----
ma_7 = MassAddition(Input=match_text_10)  # -> Result, PartialResults

# ---- group: Texts (continued)
cull_pattern_10 = CullPattern(List=simplify(graft(elements_3.Elements)), CullPattern=ma_7.Result)  # -> flatten(List)
graphical_element_7 = GraphicalElement(cull_pattern_10)

eg_overrides_7 = ElementGraphicOverrides(View=a_view, Element=graphical_element_7, Hidden=bool_2, FailureProcessingMode=1)  # -> View, Element, Hidden, Overrides
