# Grasshopper definition 40_Snapshot.gh (Grasshopper 1.0.8)
# plug-ins: Rhino.Inside for Autodesk Revit

doubleclick = BooleanToggle(False)
dss_annotation_panel = Panel("Help on WhiteWork")
# Segment
# group modules into larger coherent parts
# User Interface: I/O
dss_log_v5_2 = PythonScript(Help=doubleclick)  # inputs Help: Boolean
# ---------- dss_log_v5_2: Python ----------
"""
Set grasshopper template and provide easy acces to Help file in intranet

"""

"""
Credits:
    20211117
    Created by Vladimir Ondejcik
    White arkitekter AB

Based on:
    WOMBAT version <0.0.1>
    Script by <Brian Ringley>
        def libraries() by <Giulio Piacentino> see <http://www.grasshopper3d.com/forum/topics/gh-filename-is-python>
        def writeToFile() by <Data Analytics Society> see <https://www.youtube.com/watch?v=-TF3mXhnCDw>
    Script version <15 September 2015> 
    Copyright <Creative Commons Sharealike>
"""


#add dsearch default path located on cad.local
import sys
new_path = r"\\sesthfs02\DSEARCH\REPOSITORY\Grasshopper\Xtras\DsearchCode"
if new_path not in sys.path: sys.path.append(new_path)

#import dsearch plugin
import dsearch as ds

import os

print sys.path

#reload module (this has use when working on module)
#reload(ds.DS_Log)
#reload(ds.DS_Links)

#setup template
template=ds.DS_Links.Template
ds.DS_Log.DS_Template(template)

#run help from module 
if Help:
    helpLink=ds.DS_Links.HelpLink
    ds.DS_Log.DS_Help(helpLink)

    #turn toggle back to false
    obj=ghenv.Component.Params.Input[0].Sources[0]
    obj.Value=False
    obj.ExpireSolution(True)
# ---------- end dss_log_v5_2 ----------

dss_projectnumber = Panel("0000")
dss_projectname = Panel("name")

# ----
# Organization of Grasshopper scripts at White:
# Script should be created and annotated always with notion that other person will need to use/edit them.
# Build your script in modules and segments, use color coding and annotation according this template.
# This standard should be applied to all scripts, big or small.
# 
# Read  guide on white work:
# "https://work.white.se/grasshopper-developer-guide/"
# For Advanced users:
# For design scripts running more than a month use "dsInitialize" and "dsScriptLog" functions on Dsearch tab to log changes over time.
dss_annotation_panel_2 = Panel("""Tip of a day:
You can change default colour grups by right clicking
Graphical templates are located on "Dsearch" tab""")
# GRAPHIC
# STANDARD
# In
# data and geometry import from rhino or external platforms
image = ImageSampler(dss_annotation_panel_2, Filter="Colour", Interpolate=False, Umax=1, Umin=0, Vmax=1, Vmin=0, Wrap=0)

active_selection = GraphicalElement()  # disabled
active_selection_2 = GraphicalElement()
group = Group(active_selection_2)
group_2 = Group(active_selection_2)
null = NullItem(Item=group)  # -> NullFlags, InvalidFlags, Description
null_2 = NullItem(Item=group_2)  # -> NullFlags, InvalidFlags, Description
cull = CullPattern(List=active_selection_2, CullPattern=null.NullFlags)  # -> flatten(List)
a_view = ActiveView()
cull_2 = CullPattern(List=active_selection_2, CullPattern=invert(null_2.NullFlags))
panel = Panel(active_selection_2)
view = View(a_view)
identity = ViewIdentity(View=view)  # -> Discipline, ViewFamily, ViewName, IsDependent, IsTemplate, IsAssembly, IsPrintable
group_3 = GroupMembers(Group=cull_2)  # -> flatten(Members)
merge = Merge(Data1=cull, Data2=group_3)
viewgeom = ElementViewGeometry(Elements=merge, View=a_view)  # -> simplify(Geometry)
v_range = ViewRange(View=view)  # -> View, PrimaryRangeTop, PrimaryRangeCutPlane, PrimaryRangeBottom, ViewDepthLevel
tmatch = MatchText(Text=identity.ViewFamily, RegEx="Plan", Case=True)
brep = Brep(viewgeom)
null_3 = NullItem(Item=brep)  # -> NullFlags, InvalidFlags, Description
pln = Plane(view)

# ----
# Control
# General
# Monitor
# Out
# variable parameters and script execution
# (sliders, boolean togggle, text input,...)
# monitor data and geometry preview (used for panels for example)
# output data to rhino or external platforms
# WIP
# Annotation
# Plugin
# problematic or under repair or construction
# general annotation and notes
# textbased scripting and special plugins
# f.ex: HumanUI, kangaroo,...
dss_annotation_panel_3 = Panel("general development modules")

filter = StreamFilter(Gate=tmatch, Stream0=pln, Stream1=v_range.PrimaryRangeCutPlane)
plane = Plane(filter)
cull_3 = CullPattern(List=brep, CullPattern=invert(null_3.NullFlags))
deconstruct_brep = DeconstructBrep(Brep=cull_3)  # -> Faces, Edges, Vertices
midpt = CurveMiddle(Curve=deconstruct_brep.Edges)
crv = Curve(viewgeom)
project = Project(Geometry=deconstruct_brep.Edges, Plane=plane)  # -> Geometry, Transform
transform = Transform(Geometry=midpt, Transform=project.Transform)  # -> simplify(Geometry)
dist = Distance(PointA=midpt, PointB=transform)
null_4 = NullItem(Item=crv)  # -> NullFlags, InvalidFlags, Description
cull_4 = CullPattern(List=crv, CullPattern=invert(null_4.NullFlags))
larger = LargerThan(FirstNumber=dist, SecondNumber="5000")  # -> LargerThan, OrEqualTo
midpt_2 = CurveMiddle(Curve=cull_4)
cull_5 = CullPattern(List=project.Geometry, CullPattern=invert(larger.LargerThan))
project_2 = Project(Geometry=cull_4, Plane=plane)  # -> Geometry, Transform
transform_2 = Transform(Geometry=midpt_2, Transform=project_2.Transform)  # -> simplify(Geometry)
null_item = NullItem(Item=cull_5)  # -> NullFlags, InvalidFlags, Description
# Back-end
cull_pattern = CullPattern(List=cull_5, CullPattern=invert(null_item.InvalidFlags))  # -> simplify(List)
panel_2 = Panel(dist)
dist_2 = Distance(PointA=midpt_2, PointB=transform_2)
join_curves = JoinCurves(Curves=cull_pattern, Preserve=False)  # -> simplify(Curves)
larger_2 = LargerThan(FirstNumber=dist_2, SecondNumber="5000")  # -> LargerThan, OrEqualTo
cull_6 = CullPattern(List=project_2.Geometry, CullPattern=invert(larger_2.LargerThan))
cluster = Cluster(data=join_curves)
merge_2 = Merge(Data1=cluster, Data2=cull_6)
crv_2 = Curve(merge_2)
crv_3 = Curve(flatten(crv_2))
crv_4 = Curve(merge_2)  # disabled
null_5 = NullItem(Item=crv_4)  # -> NullFlags, InvalidFlags, Description; disabled

# ---- group: Get all unique corners
explode = Explode(Curve=crv_3, Recursive=True)  # -> Segments, flatten(Vertices)
cullpt = CullDuplicates(Points=explode.Vertices, Tolerance=0.1, CullMode=3)  # -> Points, Indices, Valence

# ----
number_slider = Slider(50, range=0..100)  # disabled
cull_7 = CullPattern(List=merge_2, CullPattern=invert(null_5.InvalidFlags))  # disabled
smaller = SmallerThan(FirstNumber=cull_7, SecondNumber=number_slider)  # -> SmallerThan, OrEqualTo; disabled

# ---- group: Remove all points not *on* each curve
crv_cp = CurveClosestPoint(Point=cullpt.Points, Curve=simplify(graft(crv_3)))  # -> Point, Parameter, Distance
smaller_2 = SmallerThan(FirstNumber=crv_cp.Distance, SecondNumber=1)  # -> SmallerThan, OrEqualTo
cull_8 = CullPattern(List=crv_cp.Parameter, CullPattern=smaller_2.SmallerThan)  # -> simplify(List)

# ----
cull_9 = CullPattern(List=cull_7, CullPattern=invert(smaller.SmallerThan))  # disabled
crv_5 = Curve(simplify(graft(crv_3)))
crv_6 = Curve(flatten(cull_9))  # disabled
explode_2 = Explode(Curve=crv_6, Recursive=True)  # -> flatten(Segments), Vertices; disabled
number_slider_2 = Slider(0, range=0..100)  # disabled
c_script = CSharpScript(curves=explode_2.Segments)  # -> out, CurveGroups; inputs curves: list of Curve; disabled
# ---------- c_script: C# ----------
    var groupDuplicateCures = GroupDuplicteCurvesA(curves);
    CurveGroups = groupDuplicateCures;
# ---------- c_script: C# additional code ----------
  public  DataTree<int> GroupDuplicteCurvesA(List<Curve> curves)
  {

    //Reverse curve direction where necesary
    var curvesToCheck = curves.Where(x => x != null)
      .Select(x => {
      if (x.PointAtStart > x.PointAtEnd) x.Reverse();
      return x;
      }).ToList();
    var nurbsCurves = curvesToCheck.Select(x => x.ToNurbsCurve()).Where(x => x != null).ToList();
    DataTree<int> CurveGroups = new DataTree<int>();
    if (curves.Count != nurbsCurves.Count)
    {
      RhinoApp.WriteLine("*** FAILED TO CONVERT TO NURBS CURVES.  CurvesCount={0},  NurbesCurveCount={1}", curves.Count, nurbsCurves);
      return CurveGroups;
    }
    if (nurbsCurves.Count < 2)
    {
      return CurveGroups;
    }
    //Now we group curves in groups based on the same hash-code retrun by our hasing method; for grouping we use ILookup
    CreateCurveHashCodeDelegate createMyCurveHashCode1 = CreateCurveHashCodeX3;
    var curvesLookupStart = nurbsCurves.Select((x, i) => new HashIndexPair(createMyCurveHashCode1(x, 101), i)).ToLookup(y => y.Hash, y => y.Id);
    var curvesLookUpShrinked = ShrinkLookup2(curvesLookupStart, nurbsCurves, 313, createMyCurveHashCode1);
    //
    bool[] DuplicateStatus = new bool[curves.Count];
    GH_Path[] curvePath = new GH_Path[curves.Count];
    var pathIndex = 0;
    foreach (var group in curvesLookUpShrinked)
    {
      var ids = group.Select(x => x).ToList();
      if (ids.Count == 1)
      {
        curvePath[ids[0]] = new GH_Path(pathIndex++);
        CurveGroups.Add(ids[0], curvePath[ids[0]]);
      }
      for (int i = 0; i < ids.Count - 1; i++)
      {
        for (int j = i + 1; j < ids.Count; j++)
        {
          if (!DuplicateStatus[ids[i]] || !DuplicateStatus[ids[j]])
          {
            if (nurbsCurves[ids[i]].EpsilonEquals(nurbsCurves[ids[j]], RhinoMath.ZeroTolerance))
            {
              if (!DuplicateStatus[ids[i]] && !DuplicateStatus[ids[j]])
              {
                curvePath[ids[i]] = new GH_Path(pathIndex++);
                curvePath[ids[j]] = curvePath[ids[i]];
                CurveGroups.Add(ids[i], curvePath[ids[i]]);
                CurveGroups.Add(ids[j], curvePath[ids[j]]);
              }
              else if (!DuplicateStatus[ids[i]] && DuplicateStatus[ids[j]])
              {
                curvePath[ids[i]] = curvePath[ids[j]];
                CurveGroups.Add(ids[i], curvePath[ids[i]]);
              }
              else if (DuplicateStatus[ids[i]] && !DuplicateStatus[ids[j]])
              {
                curvePath[ids[j]] = curvePath[ids[i]];
                CurveGroups.Add(ids[j], curvePath[ids[j]]);
              }
              DuplicateStatus[ids[i]] = true;
              DuplicateStatus[ids[j]] = true;
            }
          }
        }
      }
    }
    return CurveGroups;
  }

  public delegate uint CreateCurveHashCodeDelegate(NurbsCurve crv, int salt);

  public struct HashIndexPair
  {
    public uint Hash;
    public int Id;
    public HashIndexPair(uint hashPrm, int idPrm)
    {
      Hash = hashPrm;
      Id = idPrm;
    }
  }

  public static ILookup<uint, int> ShrinkLookup2(ILookup<uint, int> lookUpToShrink, List<NurbsCurve> curves, int salt,
    CreateCurveHashCodeDelegate createMyCurveHashCodeDelegate)
  {
    List<IGrouping<uint, int>> result = new List<IGrouping<uint, int>>();
    foreach (var group in lookUpToShrink)
    {
      int grpCount = group.Count();
      var groupLookUp = group.Select(x => new HashIndexPair(createMyCurveHashCodeDelegate(curves[x], salt), x))
        .ToLookup(y => y.Hash, y => y.Id);
      if (groupLookUp.Count > 1)
      {
        //group has been divided into more subgroups by using actual hashing-method => try to shrink subgroups more
        var shrinkMore = ShrinkLookup2(groupLookUp, curves, salt * 2 + 1, createMyCurveHashCodeDelegate);
        result.AddRange(shrinkMore);
      }
      else
      {
        result.AddRange(groupLookUp);
      }
    }
    var resultLookup = result.SelectMany(x => x.Select(y => new HashIndexPair(x.Key, y))).ToLookup(x => x.Hash, x => x.Id);
    return resultLookup;
  }

  public static uint CreateCurveHashCodeX3(NurbsCurve crv, int salt)
  {
    int myHash = 0;
    unchecked
    {
      for (int i = 0; i < crv.Knots.Count; i++)
      {
        myHash ^= crv.Knots[i].GetHashCode() * (2 * i + salt);
      }
      for (int i = 0; i < crv.Points.Count; i++)
      {
        myHash ^= saltHash(crv.Points[i].Location.GetHashCode(), salt) * (31 * i + 1);
        myHash ^= saltHash(crv.Points[i].Weight.GetHashCode(), salt) * (97 * i + 1);
      }
      myHash ^= crv.Degree * 1559;
      myHash ^= crv.Dimension * 2029;
      myHash ^= saltHash(crv.Domain.GetHashCode(), salt) * 1699;
      myHash ^= saltHash(crv.IsClosed.GetHashCode(), salt) * 4099;
      myHash ^= saltHash(crv.IsPeriodic.GetHashCode(), salt) * 4447;
      myHash ^= saltHash(crv.IsValid.GetHashCode(), salt) * 5557;
      myHash ^= crv.SpanCount * 9199;
    }
    return (uint) myHash;
  }

  public static int saltHash(int hash, int divisor)
  {
    int remainder;
    Math.DivRem(hash, divisor, out remainder);
    return hash + remainder;
  }
# ---------- end c_script ----------

# ---- group: Break each loop into segments
shatter = Shatter(Curve=crv_5, Parameters=cull_8)  # -> flatten(Segments)

# ----
item = ListItem(List=c_script.CurveGroups, Index=number_slider_2, Wrap=True)  # -> flatten(Item); disabled
item_2 = ListItem(List=explode_2.Segments, Index=item, Wrap=True)  # disabled

# ---- group: Remove duplicates
explode_3 = Explode(Curve=shatter, Recursive=True)  # -> simplify(Segments), Vertices

# ----
line = Line(flatten(explode_3.Segments))
data = Data(flatten(explode_3.Segments))
null_6 = NullItem(Item=line)  # -> NullFlags, InvalidFlags, Description
cull_10 = CullPattern(List=data, CullPattern=invert(null_6.NullFlags))

# ---- group: Remove duplicates (continued)
dupln = RemoveDuplicateLines(Lines=flatten(cull_10), Tolerance=0.01)

# ----
cull_11 = CullPattern(List=data, CullPattern=null_6.NullFlags)
cache = ContentCache(Name="Snapshot", Content=flatten([dupln, cull_11]), Action=Toggle(True))

# ==== cluster Cluster
data = ClusterInput()

# ---- group: Tree to main index
data_2 = Data(data)
clean = CleanTree(RemoveNulls=True, RemoveInvalid=True, RemoveEmpty=True, Tree=data_2)
data_3 = Data(clean)

# ---- group: Tree to main index / Gets main index from path
tstat = TreeStatistics(Tree=clean)  # -> Paths, Length, Count
split = TextSplit(Text=tstat.Paths, Separators=";")  # -> simplify(Result)
item = ListItem(List=split, Index=0, Wrap=True)
concat = Concatenate(FragmentA=item, FragmentB="}")
rep = ReplaceText(Text=concat, Find="}}", Replace="}", RecursiveReplace=False)
dup = DuplicateData(Data=rep, Number=simplify(graft(tstat.Length)), Order=True)  # -> flatten(Data)

# ---- group: Tree to main index (continued)
tree = CreateTree(Data=data_3, Path=dup)
data_4 = Data(tree)

# ----
data_5 = ClusterOutput(data_4)
