# Grasshopper definition 40_Snapshot_Save_Show.gh (Grasshopper 1.0.8)
# plug-ins: Rhino.Inside for Autodesk Revit

doubleclick = BooleanToggle(False)
dss_annotation_panel = Panel("Help on WhiteWork")
# Segment
# group modules into larger coherent parts
# User Interface: I/O
dss_log_v5_2 = PythonScript(Help=doubleclick)  # inputs Help: Boolean
# ---------- dss_log_v5_2: Python ----------
"""
Set grasshopper template and provide easy acces to Help file in intranet

"""

"""
Credits:
    20211117
    Created by Vladimir Ondejcik
    White arkitekter AB

Based on:
    WOMBAT version <0.0.1>
    Script by <Brian Ringley>
        def libraries() by <Giulio Piacentino> see <http://www.grasshopper3d.com/forum/topics/gh-filename-is-python>
        def writeToFile() by <Data Analytics Society> see <https://www.youtube.com/watch?v=-TF3mXhnCDw>
    Script version <15 September 2015> 
    Copyright <Creative Commons Sharealike>
"""


#add dsearch default path located on cad.local
import sys
new_path = r"\\sesthfs02\DSEARCH\REPOSITORY\Grasshopper\Xtras\DsearchCode"
if new_path not in sys.path: sys.path.append(new_path)

#import dsearch plugin
import dsearch as ds

import os

print sys.path

#reload module (this has use when working on module)
#reload(ds.DS_Log)
#reload(ds.DS_Links)

#setup template
template=ds.DS_Links.Template
ds.DS_Log.DS_Template(template)

#run help from module 
if Help:
    helpLink=ds.DS_Links.HelpLink
    ds.DS_Log.DS_Help(helpLink)

    #turn toggle back to false
    obj=ghenv.Component.Params.Input[0].Sources[0]
    obj.Value=False
    obj.ExpireSolution(True)
# ---------- end dss_log_v5_2 ----------

dss_projectnumber = Panel("0000")
dss_projectname = Panel("name")

# ----
# Organization of Grasshopper scripts at White:
# Script should be created and annotated always with notion that other person will need to use/edit them.
# Build your script in modules and segments, use color coding and annotation according this template.
# This standard should be applied to all scripts, big or small.
# 
# Read  guide on white work:
# "https://work.white.se/grasshopper-developer-guide/"
# For Advanced users:
# For design scripts running more than a month use "dsInitialize" and "dsScriptLog" functions on Dsearch tab to log changes over time.
dss_annotation_panel_2 = Panel("""Tip of a day:
You can change default colour grups by right clicking
Graphical templates are located on "Dsearch" tab""")
# GRAPHIC
# STANDARD
# In
# data and geometry import from rhino or external platforms
image = ImageSampler(dss_annotation_panel_2, Filter="Colour", Interpolate=False, Umax=1, Umin=0, Vmax=1, Vmin=0, Wrap=0)

active_selection = GraphicalElement()  # disabled
active_selection_2 = GraphicalElement()
toggle = BooleanToggle(True)
a_view = ActiveView()
view = View(a_view)
cache = ContentCache(Name="Snapshot", Action=toggle)  # -> simplify(Result)
identity = ViewIdentity(View=view)  # -> Discipline, ViewFamily, ViewName, IsDependent, IsTemplate, IsAssembly, IsPrintable
text = TextEntity(TextEntity=cache)  # -> TextEntity, Plane, Text, Style
v_range = ViewRange(View=view)  # -> View, PrimaryRangeTop, PrimaryRangeCutPlane, PrimaryRangeBottom, ViewDepthLevel
tmatch = MatchText(Text=identity.ViewFamily, RegEx="Plan", Case=True)
valur_list_with_bool_values = Python3Script(Items=text.Text, ToggleTrueLabel="Show", ToggleFalseLabel="Save")  # -> out, SelectedItems, ToggleValue; inputs Items: list, PreselectIndices: list of Int32
# ---------- valur_list_with_bool_values: Python ----------
"""
GhPython: ListBox selection dialog with Enter/Escape keyboard shortcuts for Rhino.Inside.Revit

Inputs:
  Items (list)            - list of objects to display (display uses str(obj))
  Title (str)             - optional dialog title (default "Select items")
  AllowMulti (bool)       - optional, allow multiple selection (default True)
  PreselectIndices (list) - optional zero-based indices to preselect (default [])
    ItemColors (list)       - optional list of colors per item (default [])
    ToggleFalseLabel (str)  - optional label for False option (default "No")
    ToggleTrueLabel (str)   - optional label for True option (default "Yes")
    ToggleDefault (bool)    - optional default value for toggle (default False)
  Width (int)             - optional dialog width (default 420)
  Height (int)            - optional dialog height (default 340)

Outputs:
  SelectedItems (list) - list of selected original items (empty if none or Cancel)
  Result (str)         - "OK" or "Cancel"
    ToggleValue (bool)   - boolean toggle value (False if Cancel)
"""

import clr
import System

# Add WinForms references
clr.AddReference("System.Windows.Forms")
clr.AddReference("System.Drawing")

from System.Windows.Forms import Form, ListBox, Button, AnchorStyles, DialogResult, Label, FormStartPosition, SelectionMode, RadioButton, DrawMode
from System.Drawing import Size, Point, Font, FontStyle, Color

# Input validation and defaults
def validate_input(var_name, default_value, expected_type=None):
    """Safely get input variable with default fallback"""
    try:
        value = globals().get(var_name, default_value)
        if value is None:
            return default_value
        if expected_type and not isinstance(value, expected_type):
            return default_value
        return value
    except:
        return default_value

# Validate all inputs
Items = validate_input('Items', [], list)
Title = validate_input('Title', "Select items", str)
AllowMulti = validate_input('AllowMulti', True, bool)
PreselectIndices = validate_input('PreselectIndices', [], list)
ItemColors = validate_input('ItemColors', [], list)
ToggleFalseLabel = validate_input('ToggleFalseLabel', "No", str)
ToggleTrueLabel = validate_input('ToggleTrueLabel', "Yes", str)
ToggleDefault = validate_input('ToggleDefault', False, bool)
Width = validate_input('Width', 420, int)
Height = validate_input('Height', 340, int)

# Ensure Width and Height are reasonable
Width = max(300, min(1200, Width))
Height = max(200, min(800, Height))

def show_listbox_dialog(items, title="Select items", allow_multi=True, preselect=None, item_colors=None, toggle_false_label="No", toggle_true_label="Yes", toggle_default=False, width=420, height=340):
    """
    Show modal dialog with a ListBox. Supports Enter->OK and Escape->Cancel.
    Returns (selected_original_items_list, result_str) where result_str is "OK" or "Cancel".
    """
    preselect = preselect or []
    original_items = list(items) if items is not None else []
    
    # Handle empty items list
    if not original_items:
        return [], "Cancel", False
    
    display_strings = [str(it) for it in original_items]
    item_colors = item_colors or []

    def normalize_color(c):
        try:
            if isinstance(c, Color):
                return c
            if isinstance(c, (list, tuple)) and len(c) >= 3:
                r, g, b = int(c[0]), int(c[1]), int(c[2])
                r = max(0, min(255, r))
                g = max(0, min(255, g))
                b = max(0, min(255, b))
                return Color.FromArgb(r, g, b)
        except:
            pass
        return None

    # Build form
    form = Form()
    form.Text = str(title)
    form.Size = Size(width, height)
    form.StartPosition = FormStartPosition.CenterScreen
    form.MinimizeBox = False
    form.MaximizeBox = False
    form.FormBorderStyle = System.Windows.Forms.FormBorderStyle.FixedDialog
    form.ShowInTaskbar = False
    form.KeyPreview = True  # capture key presses at the form level

    # Label
    label = Label()
    label.Text = "Select items and press Enter to confirm, or Esc to cancel."
    label.AutoSize = False
    label.Size = System.Drawing.Size(width - 40, 20)
    label.Location = Point(10, 10)
    form.Controls.Add(label)

    # ListBox
    lb = ListBox()
    lb.Size = Size(width - 40, height - 150)
    lb.Location = Point(10, 40)
    lb.Anchor = AnchorStyles.Top | AnchorStyles.Bottom | AnchorStyles.Left | AnchorStyles.Right
    # Selection mode
    lb.SelectionMode = SelectionMode.MultiExtended if allow_multi else SelectionMode.One
    lb.DrawMode = DrawMode.OwnerDrawFixed

    def on_draw_item(sender, e):
        try:
            e.DrawBackground()
            idx = e.Index
            if idx < 0:
                return
            text = lb.Items[idx]
            color = None
            if idx < len(item_colors):
                color = normalize_color(item_colors[idx])
            if color is None:
                color = e.ForeColor
            brush = System.Drawing.SolidBrush(color)
            e.Graphics.DrawString(str(text), e.Font, brush, e.Bounds)
            if (e.State & System.Windows.Forms.DrawItemState.Focus) == System.Windows.Forms.DrawItemState.Focus:
                e.DrawFocusRectangle()
        except:
            pass

    lb.DrawItem += on_draw_item

    # Fill listbox
    for ds in display_strings:
        lb.Items.Add(ds)
    form.Controls.Add(lb)

    # Toggle (boolean) below list - two options
    rb_false = RadioButton()
    rb_false.Text = str(toggle_false_label) if toggle_false_label is not None else "No"
    rb_false.AutoSize = True
    rb_false.Font = Font("Segoe UI", 11, FontStyle.Bold)
    rb_false.Location = Point(10, height - 115)
    rb_false.Anchor = AnchorStyles.Bottom | AnchorStyles.Left

    rb_true = RadioButton()
    rb_true.Text = str(toggle_true_label) if toggle_true_label is not None else "Yes"
    rb_true.AutoSize = True
    rb_true.Font = Font("Segoe UI", 11, FontStyle.Bold)
    rb_true.Location = Point(160, height - 115)
    rb_true.Anchor = AnchorStyles.Bottom | AnchorStyles.Left

    if bool(toggle_default):
        rb_true.Checked = True
    else:
        rb_false.Checked = True

    form.Controls.Add(rb_false)
    form.Controls.Add(rb_true)

    # Preselect indices if valid
    for idx in preselect:
        try:
            idx_int = int(idx)
            if 0 <= idx_int < lb.Items.Count:
                lb.SetSelected(idx_int, True)
        except:
            pass

    # Buttons
    btn_ok = Button()
    btn_ok.Text = "OK"
    btn_ok.Size = System.Drawing.Size(80, 28)
    btn_ok.Location = Point(width - 200, height - 80)
    btn_ok.Anchor = AnchorStyles.Bottom | AnchorStyles.Right

    def on_ok(sender, args):
        form.DialogResult = DialogResult.OK
        form.Close()
    btn_ok.Click += on_ok
    form.Controls.Add(btn_ok)

    btn_cancel = Button()
    btn_cancel.Text = "Cancel"
    btn_cancel.Size = System.Drawing.Size(80, 28)
    btn_cancel.Location = Point(width - 100, height - 80)
    btn_cancel.Anchor = AnchorStyles.Bottom | AnchorStyles.Right

    def on_cancel(sender, args):
        form.DialogResult = DialogResult.Cancel
        form.Close()
    btn_cancel.Click += on_cancel
    form.Controls.Add(btn_cancel)

    # Keyboard handling: Enter -> OK, Escape -> Cancel
    def on_key_down(sender, args):
        # args is System.Windows.Forms.KeyEventArgs
        try:
            if args.KeyCode == System.Windows.Forms.Keys.Enter:
                form.DialogResult = DialogResult.OK
                form.Close()
            elif args.KeyCode == System.Windows.Forms.Keys.Escape:
                form.DialogResult = DialogResult.Cancel
                form.Close()
        except Exception:
            # swallow exceptions from unexpected key handling
            pass

    form.KeyDown += on_key_down

    # Show modal
    res = form.ShowDialog()

    if res == DialogResult.OK:
        # Map selected indices back to original objects
        selected = []
        for i in range(lb.SelectedIndices.Count):
            idx = lb.SelectedIndices[i]
            try:
                selected.append(original_items[idx])
            except:
                selected.append(lb.Items[idx])
        return selected, "OK", bool(rb_true.Checked)
    else:
        return [], "Cancel", False

# Run dialog and set outputs
try:
    selected_items, result, toggle_value = show_listbox_dialog(Items, Title, AllowMulti, PreselectIndices, ItemColors, ToggleFalseLabel, ToggleTrueLabel, ToggleDefault, Width, Height)
except Exception as ex:
    selected_items, result, toggle_value = [], "Cancel", False
    print("Error showing selection dialog:", str(ex))

# Set Grasshopper outputs
SelectedItems = selected_items
Result = result
ToggleValue = toggle_value
# ---------- end valur_list_with_bool_values ----------
filter = StreamFilter(
    Gate=valur_list_with_bool_values.ToggleValue,
    Stream0=active_selection_2,
    Stream1=valur_list_with_bool_values.SelectedItems)
group = Group(filter)
group_2 = Group(filter)
null = NullItem(Item=group)  # -> NullFlags, InvalidFlags, Description
null_2 = NullItem(Item=group_2)  # -> NullFlags, InvalidFlags, Description
cull = CullPattern(List=filter, CullPattern=null.NullFlags)  # -> flatten(List)
cull_2 = CullPattern(List=filter, CullPattern=invert(null_2.NullFlags))
panel = Panel(filter)
group_3 = GroupMembers(Group=cull_2)  # -> flatten(Members)
merge = Merge(Data1=cull, Data2=group_3)
viewgeom = ElementViewGeometry(Elements=merge, View=a_view)  # -> simplify(Geometry)
brep = Brep(viewgeom)
null_3 = NullItem(Item=brep)  # -> NullFlags, InvalidFlags, Description
pln = Plane(view)

# ----
# Control
# General
# Monitor
# Out
# variable parameters and script execution
# (sliders, boolean togggle, text input,...)
# monitor data and geometry preview (used for panels for example)
# output data to rhino or external platforms
# WIP
# Annotation
# Plugin
# problematic or under repair or construction
# general annotation and notes
# textbased scripting and special plugins
# f.ex: HumanUI, kangaroo,...
dss_annotation_panel_3 = Panel("general development modules")

filter_2 = StreamFilter(Gate=valur_list_with_bool_values.ToggleValue, Stream1=valur_list_with_bool_values.SelectedItems)
filter_3 = StreamFilter(Gate=tmatch, Stream0=pln, Stream1=v_range.PrimaryRangeCutPlane)
plane = Plane(filter_3)
cache_2 = ContentCache(Name=filter_2, Action=toggle)  # -> simplify(Result)
cull_3 = CullPattern(List=brep, CullPattern=invert(null_3.NullFlags))
deconstruct_brep = DeconstructBrep(Brep=cull_3)  # -> Faces, Edges, Vertices
a_view_2 = ActiveView()
midpt = CurveMiddle(Curve=deconstruct_brep.Edges)
simplify = SimplifyCurve(Curve=cache_2)  # -> Curve, Simplified
crv = Curve(viewgeom)
explode = Explode(Curve=simplify.Curve, Recursive=True)  # -> simplify(Segments), Vertices
pln_2 = Plane(a_view_2)
line_patterns = QueryLinePatterns()
project = Project(Geometry=deconstruct_brep.Edges, Plane=plane)  # -> Geometry, Transform
transform = Transform(Geometry=midpt, Transform=project.Transform)  # -> simplify(Geometry)
dist = Distance(PointA=midpt, PointB=transform)
null_4 = NullItem(Item=crv)  # -> NullFlags, InvalidFlags, Description
project_2 = Project(Geometry=explode.Segments, Plane=pln_2)  # -> flatten(Geometry), Transform
cull_4 = CullPattern(List=crv, CullPattern=invert(null_4.NullFlags))
crv_2 = Curve(project_2.Geometry)
value_picker = ValuePicker(line_patterns)
larger = LargerThan(FirstNumber=dist, SecondNumber="5000")  # -> LargerThan, OrEqualTo
midpt_2 = CurveMiddle(Curve=cull_4)
cull_5 = CullPattern(List=project.Geometry, CullPattern=invert(larger.LargerThan))
c_script = CSharpScript(curves=crv_2)  # -> out, CurveGroups; inputs curves: list of Curve
# ---------- c_script: C# ----------
    var groupDuplicateCures = GroupDuplicteCurvesA(curves);
    CurveGroups = groupDuplicateCures;
# ---------- c_script: C# additional code ----------
  public  DataTree<int> GroupDuplicteCurvesA(List<Curve> curves)
  {

    //Reverse curve direction where necesary
    var curvesToCheck = curves.Where(x => x != null)
      .Select(x => {
      if (x.PointAtStart > x.PointAtEnd) x.Reverse();
      return x;
      }).ToList();
    var nurbsCurves = curvesToCheck.Select(x => x.ToNurbsCurve()).Where(x => x != null).ToList();
    DataTree<int> CurveGroups = new DataTree<int>();
    if (curves.Count != nurbsCurves.Count)
    {
      RhinoApp.WriteLine("*** FAILED TO CONVERT TO NURBS CURVES.  CurvesCount={0},  NurbesCurveCount={1}", curves.Count, nurbsCurves);
      return CurveGroups;
    }
    if (nurbsCurves.Count < 2)
    {
      return CurveGroups;
    }
    //Now we group curves in groups based on the same hash-code retrun by our hasing method; for grouping we use ILookup
    CreateCurveHashCodeDelegate createMyCurveHashCode1 = CreateCurveHashCodeX3;
    var curvesLookupStart = nurbsCurves.Select((x, i) => new HashIndexPair(createMyCurveHashCode1(x, 101), i)).ToLookup(y => y.Hash, y => y.Id);
    var curvesLookUpShrinked = ShrinkLookup2(curvesLookupStart, nurbsCurves, 313, createMyCurveHashCode1);
    //
    bool[] DuplicateStatus = new bool[curves.Count];
    GH_Path[] curvePath = new GH_Path[curves.Count];
    var pathIndex = 0;
    foreach (var group in curvesLookUpShrinked)
    {
      var ids = group.Select(x => x).ToList();
      if (ids.Count == 1)
      {
        curvePath[ids[0]] = new GH_Path(pathIndex++);
        CurveGroups.Add(ids[0], curvePath[ids[0]]);
      }
      for (int i = 0; i < ids.Count - 1; i++)
      {
        for (int j = i + 1; j < ids.Count; j++)
        {
          if (!DuplicateStatus[ids[i]] || !DuplicateStatus[ids[j]])
          {
            if (nurbsCurves[ids[i]].EpsilonEquals(nurbsCurves[ids[j]], RhinoMath.ZeroTolerance))
            {
              if (!DuplicateStatus[ids[i]] && !DuplicateStatus[ids[j]])
              {
                curvePath[ids[i]] = new GH_Path(pathIndex++);
                curvePath[ids[j]] = curvePath[ids[i]];
                CurveGroups.Add(ids[i], curvePath[ids[i]]);
                CurveGroups.Add(ids[j], curvePath[ids[j]]);
              }
              else if (!DuplicateStatus[ids[i]] && DuplicateStatus[ids[j]])
              {
                curvePath[ids[i]] = curvePath[ids[j]];
                CurveGroups.Add(ids[i], curvePath[ids[i]]);
              }
              else if (DuplicateStatus[ids[i]] && !DuplicateStatus[ids[j]])
              {
                curvePath[ids[j]] = curvePath[ids[i]];
                CurveGroups.Add(ids[j], curvePath[ids[j]]);
              }
              DuplicateStatus[ids[i]] = true;
              DuplicateStatus[ids[j]] = true;
            }
          }
        }
      }
    }
    return CurveGroups;
  }

  public delegate uint CreateCurveHashCodeDelegate(NurbsCurve crv, int salt);

  public struct HashIndexPair
  {
    public uint Hash;
    public int Id;
    public HashIndexPair(uint hashPrm, int idPrm)
    {
      Hash = hashPrm;
      Id = idPrm;
    }
  }

  public static ILookup<uint, int> ShrinkLookup2(ILookup<uint, int> lookUpToShrink, List<NurbsCurve> curves, int salt,
    CreateCurveHashCodeDelegate createMyCurveHashCodeDelegate)
  {
    List<IGrouping<uint, int>> result = new List<IGrouping<uint, int>>();
    foreach (var group in lookUpToShrink)
    {
      int grpCount = group.Count();
      var groupLookUp = group.Select(x => new HashIndexPair(createMyCurveHashCodeDelegate(curves[x], salt), x))
        .ToLookup(y => y.Hash, y => y.Id);
      if (groupLookUp.Count > 1)
      {
        //group has been divided into more subgroups by using actual hashing-method => try to shrink subgroups more
        var shrinkMore = ShrinkLookup2(groupLookUp, curves, salt * 2 + 1, createMyCurveHashCodeDelegate);
        result.AddRange(shrinkMore);
      }
      else
      {
        result.AddRange(groupLookUp);
      }
    }
    var resultLookup = result.SelectMany(x => x.Select(y => new HashIndexPair(x.Key, y))).ToLookup(x => x.Hash, x => x.Id);
    return resultLookup;
  }

  public static uint CreateCurveHashCodeX3(NurbsCurve crv, int salt)
  {
    int myHash = 0;
    unchecked
    {
      for (int i = 0; i < crv.Knots.Count; i++)
      {
        myHash ^= crv.Knots[i].GetHashCode() * (2 * i + salt);
      }
      for (int i = 0; i < crv.Points.Count; i++)
      {
        myHash ^= saltHash(crv.Points[i].Location.GetHashCode(), salt) * (31 * i + 1);
        myHash ^= saltHash(crv.Points[i].Weight.GetHashCode(), salt) * (97 * i + 1);
      }
      myHash ^= crv.Degree * 1559;
      myHash ^= crv.Dimension * 2029;
      myHash ^= saltHash(crv.Domain.GetHashCode(), salt) * 1699;
      myHash ^= saltHash(crv.IsClosed.GetHashCode(), salt) * 4099;
      myHash ^= saltHash(crv.IsPeriodic.GetHashCode(), salt) * 4447;
      myHash ^= saltHash(crv.IsValid.GetHashCode(), salt) * 5557;
      myHash ^= crv.SpanCount * 9199;
    }
    return (uint) myHash;
  }

  public static int saltHash(int hash, int divisor)
  {
    int remainder;
    Math.DivRem(hash, divisor, out remainder);
    return hash + remainder;
  }
# ---------- end c_script ----------
project_3 = Project(Geometry=cull_4, Plane=plane)  # -> Geometry, Transform
transform_2 = Transform(Geometry=midpt_2, Transform=project_3.Transform)  # -> simplify(Geometry)
null_item = NullItem(Item=cull_5)  # -> NullFlags, InvalidFlags, Description
# Back-end
cull_pattern = CullPattern(List=cull_5, CullPattern=invert(null_item.InvalidFlags))  # -> simplify(List)
panel_2 = Panel(dist)
item = ListItem(List=c_script.CurveGroups, Index=Slider(0, range=0..100), Wrap=True)
item_2 = ListItem(List=crv_2, Index=item, Wrap=True)
dist_2 = Distance(PointA=midpt_2, PointB=transform_2)

# ---- group: Create custom line style
built_in_categories = BuiltInCategories("autodesk.revit.category.local:lines-1.0.0", LayoutLevel=2, SearchPattern="lines")
subcat = AddSubCategory(Parent=built_in_categories, Name="Line_Snapshot_RiR", FailureProcessingMode=1, TrackingMode=2)
catstyle = CategoryStyle(
    Category=subcat,
    LineWeight_projection="5",
    LineColor=ColourSwatch(SwatchColor=RGB(73, 83, 255)),
    LinePattern_projection=value_picker)  # -> Category, LineWeight_projection, LineWeight_cut, LineColor, LinePattern_projection, Material

# ----
join_curves = JoinCurves(Curves=cull_pattern, Preserve=False)  # -> simplify(Curves)
larger_2 = LargerThan(FirstNumber=dist_2, SecondNumber="5000")  # -> LargerThan, OrEqualTo
d_line = AddDetailLine(View=simplify(graft(a_view_2)), Curve=item_2, FailureProcessingMode=1)  # -> simplify(DetailLine)
cull_6 = CullPattern(List=project_3.Geometry, CullPattern=invert(larger_2.LargerThan))
cluster = Cluster(data=join_curves)
linestyle = CurveLineStyle(Element=d_line, LineStyle=catstyle.Category)  # -> Element, LineStyle
merge_2 = Merge(Data1=cluster, Data2=cull_6)
crv_3 = Curve(merge_2)
crv_4 = Curve(flatten(crv_3))
pinelem = PinElement(Element=linestyle.Element, Pinned=Toggle(False))  # -> Element, Pinned

# ---- group: Get all unique corners
explode_2 = Explode(Curve=crv_4, Recursive=True)  # -> Segments, flatten(Vertices)
cullpt = CullDuplicates(Points=explode_2.Vertices, Tolerance=0.1, CullMode=3)  # -> Points, Indices, Valence

# ----
selelems = SelectElement(Element=pinelem.Element, Selected=Toggle(True))  # -> Element, Selected

# ---- group: Remove all points not *on* each curve
crv_cp = CurveClosestPoint(Point=cullpt.Points, Curve=simplify(graft(crv_4)))  # -> Point, Parameter, Distance
smaller = SmallerThan(FirstNumber=crv_cp.Distance, SecondNumber=1)  # -> SmallerThan, OrEqualTo
cull_7 = CullPattern(List=crv_cp.Parameter, CullPattern=smaller.SmallerThan)  # -> simplify(List)

# ----
crv_5 = Curve(simplify(graft(crv_4)))

# ---- group: Break each loop into segments
shatter = Shatter(Curve=crv_5, Parameters=cull_7)  # -> flatten(Segments)

# ----
toggle_2 = BooleanToggle(True)
cache_3 = ContentCache(Name="Snapshot", Action=Toggle(True))  # -> simplify(Result)

# ---- group: Time Stamp
python = PythonScript(x=Button())  # -> out, Y, M, D, h, m, s
# ---------- python: Python ----------
import datetime
now = datetime.datetime.now()
Y = now.year
M = now.month
D = now.day
h = now.hour
m = now.minute
s = now.second
# ---------- end python ----------

# ----
len = TextLength(Text=python.s)
smaller_2 = SmallerThan(FirstNumber=len, SecondNumber="2")  # -> SmallerThan, OrEqualTo
concat = Concatenate(FragmentA="0", FragmentB=python.s)
filter_4 = StreamFilter(Gate=smaller_2.SmallerThan, Stream0=python.s, Stream1=concat)

len_2 = TextLength(Text=python.h)
smaller_3 = SmallerThan(FirstNumber=len_2, SecondNumber="2")  # -> SmallerThan, OrEqualTo
concat_2 = Concatenate(FragmentA="0", FragmentB=python.h)
filter_5 = StreamFilter(Gate=smaller_3.SmallerThan, Stream0=python.h, Stream1=concat_2)

len_3 = TextLength(Text=python.m)
smaller_4 = SmallerThan(FirstNumber=len_3, SecondNumber="2")  # -> SmallerThan, OrEqualTo
concat_3 = Concatenate(FragmentA="0", FragmentB=python.m)
filter_6 = StreamFilter(Gate=smaller_4.SmallerThan, Stream0=python.m, Stream1=concat_3)
expression = Expression(x=filter_5, y=filter_6, z=filter_4, Expression="Format(\"{0}:{1}:{2}\", x, y,z)")

# ---- group: Time Stamp (continued)
panel_3 = Panel(expression)
concat_4 = Concatenate(FragmentA="Snapshot", FragmentC=panel_3, JoinSeparator="_")

# ----
text_2 = TextEntity(Text=concat_4)  # -> TextEntity, Plane, Text, Style

# ---- group: Remove duplicates
explode_3 = Explode(Curve=shatter, Recursive=True)  # -> simplify(Segments), Vertices

# ----
line = Line(flatten(explode_3.Segments))
null_5 = NullItem(Item=line)  # -> NullFlags, InvalidFlags, Description
data = Data(flatten(explode_3.Segments))
cull_8 = CullPattern(List=data, CullPattern=invert(null_5.NullFlags))
cull_9 = CullPattern(List=data, CullPattern=null_5.NullFlags)

# ---- group: Remove duplicates (continued)
dupln = RemoveDuplicateLines(Lines=flatten(cull_8), Tolerance=0.01)

# ----
lng = ListLength(List=dupln)
bool = Boolean(lng)
cache_4 = ContentCache(Name=concat_4, Content=flatten([dupln, cull_9]), Action=toggle_2)
filter_7 = StreamFilter(Gate=bool, Stream1=cache_3)
merge_3 = Merge(Data1=text_2.TextEntity, Data2=filter_7)
cache_5 = ContentCache(Name="Snapshot", Content=flatten(merge_3), Action=toggle_2)

# ==== cluster Cluster
data = ClusterInput()

# ---- group: Tree to main index
data_2 = Data(data)
clean = CleanTree(RemoveNulls=True, RemoveInvalid=True, RemoveEmpty=True, Tree=data_2)
data_3 = Data(clean)

# ---- group: Tree to main index / Gets main index from path
tstat = TreeStatistics(Tree=clean)  # -> Paths, Length, Count
split = TextSplit(Text=tstat.Paths, Separators=";")  # -> simplify(Result)
item = ListItem(List=split, Index=0, Wrap=True)
concat = Concatenate(FragmentA=item, FragmentB="}")
rep = ReplaceText(Text=concat, Find="}}", Replace="}", RecursiveReplace=False)
dup = DuplicateData(Data=rep, Number=simplify(graft(tstat.Length)), Order=True)  # -> flatten(Data)

# ---- group: Tree to main index (continued)
tree = CreateTree(Data=data_3, Path=dup)
data_4 = Data(tree)

# ----
data_5 = ClusterOutput(data_4)
