# Grasshopper definition 41_Snapshot_Show.gh (Grasshopper 1.0.8)
# plug-ins: Rhino.Inside for Autodesk Revit

doubleclick = BooleanToggle(False)
dss_annotation_panel = Panel("Help on WhiteWork")
# Segment
# group modules into larger coherent parts
# User Interface: I/O
dss_log_v5_2 = PythonScript(Help=doubleclick)  # inputs Help: Boolean
# ---------- dss_log_v5_2: Python ----------
"""
Set grasshopper template and provide easy acces to Help file in intranet

"""

"""
Credits:
    20211117
    Created by Vladimir Ondejcik
    White arkitekter AB

Based on:
    WOMBAT version <0.0.1>
    Script by <Brian Ringley>
        def libraries() by <Giulio Piacentino> see <http://www.grasshopper3d.com/forum/topics/gh-filename-is-python>
        def writeToFile() by <Data Analytics Society> see <https://www.youtube.com/watch?v=-TF3mXhnCDw>
    Script version <15 September 2015> 
    Copyright <Creative Commons Sharealike>
"""


#add dsearch default path located on cad.local
import sys
new_path = r"\\sesthfs02\DSEARCH\REPOSITORY\Grasshopper\Xtras\DsearchCode"
if new_path not in sys.path: sys.path.append(new_path)

#import dsearch plugin
import dsearch as ds

import os

print sys.path

#reload module (this has use when working on module)
#reload(ds.DS_Log)
#reload(ds.DS_Links)

#setup template
template=ds.DS_Links.Template
ds.DS_Log.DS_Template(template)

#run help from module 
if Help:
    helpLink=ds.DS_Links.HelpLink
    ds.DS_Log.DS_Help(helpLink)

    #turn toggle back to false
    obj=ghenv.Component.Params.Input[0].Sources[0]
    obj.Value=False
    obj.ExpireSolution(True)
# ---------- end dss_log_v5_2 ----------

dss_projectnumber = Panel("0000")
dss_projectname = Panel("name")

# ----
# Organization of Grasshopper scripts at White:
# Script should be created and annotated always with notion that other person will need to use/edit them.
# Build your script in modules and segments, use color coding and annotation according this template.
# This standard should be applied to all scripts, big or small.
# 
# Read  guide on white work:
# "https://work.white.se/grasshopper-developer-guide/"
# For Advanced users:
# For design scripts running more than a month use "dsInitialize" and "dsScriptLog" functions on Dsearch tab to log changes over time.
dss_annotation_panel_2 = Panel("""Tip of a day:
You can change default colour grups by right clicking
Graphical templates are located on "Dsearch" tab""")
# GRAPHIC
# STANDARD
# In
# data and geometry import from rhino or external platforms
image = ImageSampler(dss_annotation_panel_2, Filter="Colour", Interpolate=False, Umax=1, Umin=0, Vmax=1, Vmin=0, Wrap=0)

cache = ContentCache(Name="Snapshot", Action=Toggle(True))  # -> simplify(Result)

# ----
# Control
# General
# Monitor
# Out
# variable parameters and script execution
# (sliders, boolean togggle, text input,...)
# monitor data and geometry preview (used for panels for example)
# output data to rhino or external platforms
# WIP
# Annotation
# Plugin
# general annotation and notes
# textbased scripting and special plugins
# f.ex: HumanUI, kangaroo,...
# problematic or under repair or construction
dss_annotation_panel_3 = Panel("general development modules")

a_view = ActiveView()
simplify = SimplifyCurve(Curve=cache)  # -> Curve, Simplified
explode = Explode(Curve=simplify.Curve, Recursive=True)  # -> simplify(Segments), Vertices
pln = Plane(a_view)
line_patterns = QueryLinePatterns()
project = Project(Geometry=explode.Segments, Plane=pln)  # -> flatten(Geometry), Transform
crv = Curve(project.Geometry)
value_picker = ValuePicker(line_patterns)
c_script = CSharpScript(curves=crv)  # -> out, CurveGroups; inputs curves: list of Curve
# ---------- c_script: C# ----------
    var groupDuplicateCures = GroupDuplicteCurvesA(curves);
    CurveGroups = groupDuplicateCures;
# ---------- c_script: C# additional code ----------
  public  DataTree<int> GroupDuplicteCurvesA(List<Curve> curves)
  {

    //Reverse curve direction where necesary
    var curvesToCheck = curves.Where(x => x != null)
      .Select(x => {
      if (x.PointAtStart > x.PointAtEnd) x.Reverse();
      return x;
      }).ToList();
    var nurbsCurves = curvesToCheck.Select(x => x.ToNurbsCurve()).Where(x => x != null).ToList();
    DataTree<int> CurveGroups = new DataTree<int>();
    if (curves.Count != nurbsCurves.Count)
    {
      RhinoApp.WriteLine("*** FAILED TO CONVERT TO NURBS CURVES.  CurvesCount={0},  NurbesCurveCount={1}", curves.Count, nurbsCurves);
      return CurveGroups;
    }
    if (nurbsCurves.Count < 2)
    {
      return CurveGroups;
    }
    //Now we group curves in groups based on the same hash-code retrun by our hasing method; for grouping we use ILookup
    CreateCurveHashCodeDelegate createMyCurveHashCode1 = CreateCurveHashCodeX3;
    var curvesLookupStart = nurbsCurves.Select((x, i) => new HashIndexPair(createMyCurveHashCode1(x, 101), i)).ToLookup(y => y.Hash, y => y.Id);
    var curvesLookUpShrinked = ShrinkLookup2(curvesLookupStart, nurbsCurves, 313, createMyCurveHashCode1);
    //
    bool[] DuplicateStatus = new bool[curves.Count];
    GH_Path[] curvePath = new GH_Path[curves.Count];
    var pathIndex = 0;
    foreach (var group in curvesLookUpShrinked)
    {
      var ids = group.Select(x => x).ToList();
      if (ids.Count == 1)
      {
        curvePath[ids[0]] = new GH_Path(pathIndex++);
        CurveGroups.Add(ids[0], curvePath[ids[0]]);
      }
      for (int i = 0; i < ids.Count - 1; i++)
      {
        for (int j = i + 1; j < ids.Count; j++)
        {
          if (!DuplicateStatus[ids[i]] || !DuplicateStatus[ids[j]])
          {
            if (nurbsCurves[ids[i]].EpsilonEquals(nurbsCurves[ids[j]], RhinoMath.ZeroTolerance))
            {
              if (!DuplicateStatus[ids[i]] && !DuplicateStatus[ids[j]])
              {
                curvePath[ids[i]] = new GH_Path(pathIndex++);
                curvePath[ids[j]] = curvePath[ids[i]];
                CurveGroups.Add(ids[i], curvePath[ids[i]]);
                CurveGroups.Add(ids[j], curvePath[ids[j]]);
              }
              else if (!DuplicateStatus[ids[i]] && DuplicateStatus[ids[j]])
              {
                curvePath[ids[i]] = curvePath[ids[j]];
                CurveGroups.Add(ids[i], curvePath[ids[i]]);
              }
              else if (DuplicateStatus[ids[i]] && !DuplicateStatus[ids[j]])
              {
                curvePath[ids[j]] = curvePath[ids[i]];
                CurveGroups.Add(ids[j], curvePath[ids[j]]);
              }
              DuplicateStatus[ids[i]] = true;
              DuplicateStatus[ids[j]] = true;
            }
          }
        }
      }
    }
    return CurveGroups;
  }

  public delegate uint CreateCurveHashCodeDelegate(NurbsCurve crv, int salt);

  public struct HashIndexPair
  {
    public uint Hash;
    public int Id;
    public HashIndexPair(uint hashPrm, int idPrm)
    {
      Hash = hashPrm;
      Id = idPrm;
    }
  }

  public static ILookup<uint, int> ShrinkLookup2(ILookup<uint, int> lookUpToShrink, List<NurbsCurve> curves, int salt,
    CreateCurveHashCodeDelegate createMyCurveHashCodeDelegate)
  {
    List<IGrouping<uint, int>> result = new List<IGrouping<uint, int>>();
    foreach (var group in lookUpToShrink)
    {
      int grpCount = group.Count();
      var groupLookUp = group.Select(x => new HashIndexPair(createMyCurveHashCodeDelegate(curves[x], salt), x))
        .ToLookup(y => y.Hash, y => y.Id);
      if (groupLookUp.Count > 1)
      {
        //group has been divided into more subgroups by using actual hashing-method => try to shrink subgroups more
        var shrinkMore = ShrinkLookup2(groupLookUp, curves, salt * 2 + 1, createMyCurveHashCodeDelegate);
        result.AddRange(shrinkMore);
      }
      else
      {
        result.AddRange(groupLookUp);
      }
    }
    var resultLookup = result.SelectMany(x => x.Select(y => new HashIndexPair(x.Key, y))).ToLookup(x => x.Hash, x => x.Id);
    return resultLookup;
  }

  public static uint CreateCurveHashCodeX3(NurbsCurve crv, int salt)
  {
    int myHash = 0;
    unchecked
    {
      for (int i = 0; i < crv.Knots.Count; i++)
      {
        myHash ^= crv.Knots[i].GetHashCode() * (2 * i + salt);
      }
      for (int i = 0; i < crv.Points.Count; i++)
      {
        myHash ^= saltHash(crv.Points[i].Location.GetHashCode(), salt) * (31 * i + 1);
        myHash ^= saltHash(crv.Points[i].Weight.GetHashCode(), salt) * (97 * i + 1);
      }
      myHash ^= crv.Degree * 1559;
      myHash ^= crv.Dimension * 2029;
      myHash ^= saltHash(crv.Domain.GetHashCode(), salt) * 1699;
      myHash ^= saltHash(crv.IsClosed.GetHashCode(), salt) * 4099;
      myHash ^= saltHash(crv.IsPeriodic.GetHashCode(), salt) * 4447;
      myHash ^= saltHash(crv.IsValid.GetHashCode(), salt) * 5557;
      myHash ^= crv.SpanCount * 9199;
    }
    return (uint) myHash;
  }

  public static int saltHash(int hash, int divisor)
  {
    int remainder;
    Math.DivRem(hash, divisor, out remainder);
    return hash + remainder;
  }
# ---------- end c_script ----------
item = ListItem(List=c_script.CurveGroups, Index=Slider(0, range=0..100), Wrap=True)
item_2 = ListItem(List=crv, Index=item, Wrap=True)

# ---- group: Create custom line style
built_in_categories = BuiltInCategories("autodesk.revit.category.local:lines-1.0.0", LayoutLevel=2, SearchPattern="lines")
subcat = AddSubCategory(Parent=built_in_categories, Name="Line_Snapshot_RiR", FailureProcessingMode=1, TrackingMode=2)
catstyle = CategoryStyle(
    Category=subcat,
    LineWeight_projection="5",
    LineColor=ColourSwatch(SwatchColor=RGB(73, 83, 255)),
    LinePattern_projection=value_picker)  # -> Category, LineWeight_projection, LineWeight_cut, LineColor, LinePattern_projection, Material

# ----
# Back-end
d_line = AddDetailLine(View=simplify(graft(a_view)), Curve=item_2, FailureProcessingMode=1)  # -> simplify(DetailLine)
linestyle = CurveLineStyle(Element=d_line, LineStyle=catstyle.Category)  # -> Element, LineStyle
pinelem = PinElement(Element=linestyle.Element, Pinned=Toggle(False))  # -> Element, Pinned
selelems = SelectElement(Element=pinelem.Element, Selected=Toggle(True))  # -> Element, Selected
